# Grasshopper definition test_main_1.gh (Grasshopper 1.0.8)
# plug-ins: PTComponentLibrary, PlanFinderGH, NGon_RH8

# ---- group: Getting all block vertices
panel = Panel("66.565,-2.058,0.000;77.164,46.940,0.000/49.339,0.792,0.000;60.503,49.919,0.000;39.954,56.409,0.000")
envelope_block_vertices = GetString(panel, AtLeast=1, AtMost=1, TreeAccess=False)
block_vertices = Data(envelope_block_vertices)
tmatch = MatchText(Text=block_vertices, Pattern="0", Case=True)
gate = StreamGate(Stream=block_vertices, Gate=tmatch)  # -> Target0, Target1
split = TextSplit(Text=gate.Target0, Separators="/")
split_2 = TextSplit(Text=split, Separators=";")
pline = PolyLine(Vertices=split_2, Closed=False)

# ----
envelope_mode = GetNumber(Slider(1, range=0..10), AtLeast=1, AtMost=1, Maximum=1.797693135e+308, Minimum=-1.797693135e+308, TreeAccess=False)
massing_mode = Equality(FirstNumber=envelope_mode, SecondNumber="0")  # -> Equality, Inequality
unitmix = Equality(FirstNumber=envelope_mode, SecondNumber="1")  # -> Equality, Inequality
floorplan = Equality(FirstNumber=envelope_mode, SecondNumber="2")  # -> Equality, Inequality
basement = Equality(FirstNumber=envelope_mode, SecondNumber="3")  # -> Equality, Inequality
facade = Equality(FirstNumber=envelope_mode, SecondNumber="4")  # -> Equality, Inequality
bang = ExplodeTree(Data=pline)  # -> Branch0, Branch1, Branch2, Branch3, Branch4, Branch5, Branch6, Branch7, Branch8, Branch9
massing_mode_2 = Boolean(massing_mode.Equality)

block1_curve = Data(bang.Branch0)
block1_width = GetNumber(Slider(10, range=10..20), AtLeast=1, AtMost=1, Maximum=1.797693135e+308, Minimum=-1.797693135e+308, TreeAccess=False)
block1_no_of_floors = GetNumber(Slider(3, range=0..10), AtLeast=1, AtMost=1, Maximum=1.797693135e+308, Minimum=-1.797693135e+308, TreeAccess=False)
block1_floor_height = GetNumber(Slider(3, range=0..10), AtLeast=1, AtMost=1, Maximum=1.797693135e+308, Minimum=-1.797693135e+308, TreeAccess=False)
no_of_floors = Data(block1_no_of_floors)
block_width = Data(block1_width)
floor_height = Data(block1_floor_height)
division = Division(A=block_width, B="2")
multiplication = Multiplication(A=floor_height, B=no_of_floors)
series = Series(Start=floor_height, Step=floor_height, Count=no_of_floors)
neg = Negative(Value=division)
Z = UnitZ(Factor=series)
offset = OffsetCurve(Curve=block1_curve, Distance=[division, neg], Corners=1)
pshift = ShiftPaths(Data=offset, Offset=-1)
end = EndPoints(Curve=pshift)  # -> Start, End
item = ListItem(List=end.Start, Index=0, Wrap=True)
item_2 = ListItem(List=end.Start, Index=1, Wrap=True)
item_3 = ListItem(List=end.End, Index=0, Wrap=True)
item_4 = ListItem(List=end.End, Index=1, Wrap=True)
ln = Line(StartPoint=item, EndPoint=item_2)
ln_2 = Line(StartPoint=item_3, EndPoint=item_4)
merge = Merge(Data1=ln, Data2=ln_2, Data3=pshift)
join = JoinCurves(Curves=merge, Preserve=False)
Z_2 = UnitZ(Factor=multiplication)
srf = Surface(join)
block1_type = GetNumber(Slider(0, range=0..1), AtLeast=1, AtMost=1, Maximum=1.797693135e+308, Minimum=-1.797693135e+308, TreeAccess=False)
gate_2 = StreamGate(Stream=srf, Gate=massing_mode_2)  # -> Target0, Target1
extr = Extrude(Base=gate_2.Target1, Direction=Z_2)
Z_3 = UnitZ(Factor=Slider(0.01, range=0..0.01))
move = Move(Geometry=extr, Motion=Z_3)  # -> Geometry, Transform
filter = StreamFilter(Gate=block1_type, Stream0="#F9627D", Stream1="#83B692")
mcol = MeshColours(Mesh=move.Geometry, Colours=graft(filter))

block2_curve = Data(bang.Branch1)
block2_width = GetNumber(Slider(8, range=0..100), AtLeast=1, AtMost=1, Maximum=1.797693135e+308, Minimum=-1.797693135e+308, TreeAccess=False)
block2_no_of_floors = GetNumber(Slider(3, range=0..10), AtLeast=1, AtMost=1, Maximum=1.797693135e+308, Minimum=-1.797693135e+308, TreeAccess=False)
block2_floor_height = GetNumber(Slider(3, range=0..10), AtLeast=1, AtMost=1, Maximum=1.797693135e+308, Minimum=-1.797693135e+308, TreeAccess=False)
no_of_floors_2 = Data(block2_no_of_floors)
block_width_2 = Data(block2_width)
floor_height_2 = Data(block2_floor_height)
division_2 = Division(A=block_width_2, B="2")
multiplication_2 = Multiplication(A=floor_height_2, B=no_of_floors_2)
series_2 = Series(Start=floor_height_2, Step=floor_height_2, Count=no_of_floors_2)
neg_2 = Negative(Value=division_2)
Z_4 = UnitZ(Factor=series_2)
offset_2 = OffsetCurve(Curve=block2_curve, Distance=[division_2, neg_2], Corners=1)
pshift_2 = ShiftPaths(Data=offset_2, Offset=-1)
end_2 = EndPoints(Curve=pshift_2)  # -> Start, End
item_5 = ListItem(List=end_2.Start, Index=0, Wrap=True)
item_6 = ListItem(List=end_2.Start, Index=1, Wrap=True)
item_7 = ListItem(List=end_2.End, Index=0, Wrap=True)
item_8 = ListItem(List=end_2.End, Index=1, Wrap=True)
ln_3 = Line(StartPoint=item_5, EndPoint=item_6)
ln_4 = Line(StartPoint=item_7, EndPoint=item_8)
merge_2 = Merge(Data1=ln_3, Data2=ln_4, Data3=pshift_2)
join_2 = JoinCurves(Curves=merge_2, Preserve=False)
Z_5 = UnitZ(Factor=multiplication_2)
srf_2 = Surface(join_2)
gate_3 = StreamGate(Stream=srf_2, Gate=massing_mode_2)  # -> Target0, Target1
block2_type = GetNumber(Slider(0, range=0..1), AtLeast=1, AtMost=1, Maximum=1.797693135e+308, Minimum=-1.797693135e+308, TreeAccess=False)
extr_2 = Extrude(Base=gate_3.Target1, Direction=Z_5)
Z_6 = UnitZ(Factor=Slider(0.01, range=0..0.01))
move_2 = Move(Geometry=extr_2, Motion=Z_6)  # -> Geometry, Transform
filter_2 = StreamFilter(Gate=block2_type, Stream0="#F9627D", Stream1="#83B692")
mcol_2 = MeshColours(Mesh=move_2.Geometry, Colours=graft(filter_2))

block1_corridoor = GetNumber(Slider(2, range=2..4), AtLeast=1, AtMost=1, Maximum=1.797693135e+308, Minimum=-1.797693135e+308, TreeAccess=False)
block3_type = GetNumber(Slider(0, range=0..1), AtLeast=1, AtMost=1, Maximum=1.797693135e+308, Minimum=-1.797693135e+308, TreeAccess=False)
block4_type = GetNumber(Slider(0, range=0..1), AtLeast=1, AtMost=1, Maximum=1.797693135e+308, Minimum=-1.797693135e+308, TreeAccess=False)
block5_type = GetNumber(Slider(0, range=0..1), AtLeast=1, AtMost=1, Maximum=1.797693135e+308, Minimum=-1.797693135e+308, TreeAccess=False)
filter_3 = StreamFilter(Gate=block3_type, Stream0="#F9627D", Stream1="#83B692")

block3_curve = Data(bang.Branch2)
block3_width = GetNumber(Slider(8, range=0..100), AtLeast=1, AtMost=1, Maximum=1.797693135e+308, Minimum=-1.797693135e+308, TreeAccess=False)
block3_no_of_floors = GetNumber(Slider(3, range=0..10), AtLeast=1, AtMost=1, Maximum=1.797693135e+308, Minimum=-1.797693135e+308, TreeAccess=False)
block3_floor_height = GetNumber(Slider(3, range=0..10), AtLeast=1, AtMost=1, Maximum=1.797693135e+308, Minimum=-1.797693135e+308, TreeAccess=False)
no_of_floors_3 = Data(block3_no_of_floors)
block_width_3 = Data(block3_width)
floor_height_3 = Data(block3_floor_height)
division_3 = Division(A=block_width_3, B="2")
multiplication_3 = Multiplication(A=floor_height_3, B=no_of_floors_3)
series_3 = Series(Start=floor_height_3, Step=floor_height_3, Count=no_of_floors_3)
neg_3 = Negative(Value=division_3)
Z_7 = UnitZ(Factor=series_3)
offset_3 = OffsetCurve(Curve=block3_curve, Distance=[division_3, neg_3], Corners=1)
pshift_3 = ShiftPaths(Data=offset_3, Offset=-1)
end_3 = EndPoints(Curve=pshift_3)  # -> Start, End
item_9 = ListItem(List=end_3.Start, Index=0, Wrap=True)
item_10 = ListItem(List=end_3.Start, Index=1, Wrap=True)
item_11 = ListItem(List=end_3.End, Index=0, Wrap=True)
item_12 = ListItem(List=end_3.End, Index=1, Wrap=True)
ln_5 = Line(StartPoint=item_9, EndPoint=item_10)
ln_6 = Line(StartPoint=item_11, EndPoint=item_12)
merge_3 = Merge(Data1=ln_5, Data2=ln_6, Data3=pshift_3)
join_3 = JoinCurves(Curves=merge_3, Preserve=False)
Z_8 = UnitZ(Factor=multiplication_3)
srf_3 = Surface(join_3)
gate_4 = StreamGate(Stream=srf_3, Gate=massing_mode_2)  # -> Target0, Target1
extr_3 = Extrude(Base=gate_4.Target1, Direction=Z_8)
Z_9 = UnitZ(Factor=Slider(0.01, range=0..0.01))
move_3 = Move(Geometry=extr_3, Motion=Z_9)  # -> Geometry, Transform
mcol_3 = MeshColours(Mesh=move_3.Geometry, Colours=graft(filter_3))

filter_4 = StreamFilter(Gate=block4_type, Stream0="#F9627D", Stream1="#83B692")

block4_curve = Data(bang.Branch3)
block4_width = GetNumber(Slider(8, range=0..100), AtLeast=1, AtMost=1, Maximum=1.797693135e+308, Minimum=-1.797693135e+308, TreeAccess=False)
block4_no_of_floors = GetNumber(Slider(3, range=0..10), AtLeast=1, AtMost=1, Maximum=1.797693135e+308, Minimum=-1.797693135e+308, TreeAccess=False)
block4_floor_height = GetNumber(Slider(3, range=0..10), AtLeast=1, AtMost=1, Maximum=1.797693135e+308, Minimum=-1.797693135e+308, TreeAccess=False)
block_width_4 = Data(block4_width)
no_of_floors_4 = Data(block4_no_of_floors)
floor_height_4 = Data(block4_floor_height)
division_4 = Division(A=block_width_4, B="2")
multiplication_4 = Multiplication(A=floor_height_4, B=no_of_floors_4)
series_4 = Series(Start=floor_height_4, Step=floor_height_4, Count=no_of_floors_4)
neg_4 = Negative(Value=division_4)
Z_10 = UnitZ(Factor=series_4)
offset_4 = OffsetCurve(Curve=block4_curve, Distance=[division_4, neg_4], Corners=1)
pshift_4 = ShiftPaths(Data=offset_4, Offset=-1)
end_4 = EndPoints(Curve=pshift_4)  # -> Start, End
item_13 = ListItem(List=end_4.Start, Index=0, Wrap=True)
item_14 = ListItem(List=end_4.Start, Index=1, Wrap=True)
item_15 = ListItem(List=end_4.End, Index=0, Wrap=True)
item_16 = ListItem(List=end_4.End, Index=1, Wrap=True)
ln_7 = Line(StartPoint=item_13, EndPoint=item_14)
ln_8 = Line(StartPoint=item_15, EndPoint=item_16)
merge_4 = Merge(Data1=ln_7, Data2=ln_8, Data3=pshift_4)
join_4 = JoinCurves(Curves=merge_4, Preserve=False)
Z_11 = UnitZ(Factor=multiplication_4)
srf_4 = Surface(join_4)
gate_5 = StreamGate(Stream=srf_4, Gate=massing_mode_2)  # -> Target0, Target1
extr_4 = Extrude(Base=gate_5.Target1, Direction=Z_11)
Z_12 = UnitZ(Factor=Slider(0.01, range=0..0.01))
move_4 = Move(Geometry=extr_4, Motion=Z_12)  # -> Geometry, Transform
mcol_4 = MeshColours(Mesh=move_4.Geometry, Colours=graft(filter_4))

filter_5 = StreamFilter(Gate=block5_type, Stream0="#F9627D", Stream1="#83B692")

block5_curve = Data(bang.Branch4)
block5_width = GetNumber(Slider(8, range=0..100), AtLeast=1, AtMost=1, Maximum=1.797693135e+308, Minimum=-1.797693135e+308, TreeAccess=False)
block5_no_of_floors = GetNumber(Slider(3, range=0..10), AtLeast=1, AtMost=1, Maximum=1.797693135e+308, Minimum=-1.797693135e+308, TreeAccess=False)
block5_floor_height = GetNumber(Slider(3, range=0..10), AtLeast=1, AtMost=1, Maximum=1.797693135e+308, Minimum=-1.797693135e+308, TreeAccess=False)
block_width_5 = Data(block5_width)
no_of_floors_5 = Data(block5_no_of_floors)
floor_height_5 = Data(block5_floor_height)
division_5 = Division(A=block_width_5, B="2")
multiplication_5 = Multiplication(A=floor_height_5, B=no_of_floors_5)
series_5 = Series(Start=floor_height_5, Step=floor_height_5, Count=no_of_floors_5)
neg_5 = Negative(Value=division_5)
Z_13 = UnitZ(Factor=series_5)
offset_5 = OffsetCurve(Curve=block5_curve, Distance=[division_5, neg_5], Corners=1)
pshift_5 = ShiftPaths(Data=offset_5, Offset=-1)
end_5 = EndPoints(Curve=pshift_5)  # -> Start, End
item_17 = ListItem(List=end_5.Start, Index=0, Wrap=True)
item_18 = ListItem(List=end_5.Start, Index=1, Wrap=True)
item_19 = ListItem(List=end_5.End, Index=0, Wrap=True)
item_20 = ListItem(List=end_5.End, Index=1, Wrap=True)
ln_9 = Line(StartPoint=item_17, EndPoint=item_18)
ln_10 = Line(StartPoint=item_19, EndPoint=item_20)
merge_5 = Merge(Data1=ln_9, Data2=ln_10, Data3=pshift_5)
join_5 = JoinCurves(Curves=merge_5, Preserve=False)
Z_14 = UnitZ(Factor=multiplication_5)
srf_5 = Surface(join_5)
gate_6 = StreamGate(Stream=srf_5, Gate=massing_mode_2)  # -> Target0, Target1
extr_5 = Extrude(Base=gate_6.Target1, Direction=Z_14)
Z_15 = UnitZ(Factor=Slider(0.01, range=0..0.01))
move_5 = Move(Geometry=extr_5, Motion=Z_15)  # -> Geometry, Transform
mcol_5 = MeshColours(Mesh=move_5.Geometry, Colours=graft(filter_5))

# ---- group: Massing stage
merge_6 = Merge(Data1=mcol, Data2=mcol_2, Data3=mcol_3, Data4=mcol_4, Data5=mcol_5)

# ----
corridoor_width = Data(block1_corridoor)
centerline = Curve(block1_curve)
blocktype = Data(block1_type)
srf_6 = Surface(srf)
debrep = DeconstructBrep(Brep=srf_6)  # -> Faces, Edges, Vertices
item_21 = ListItem(List=debrep.Edges, Index=Slider(3, range=0..10), Wrap=True)
item_22 = ListItem(List=debrep.Edges, Index=Slider(2, range=0..10), Wrap=True)
unitmix_block1_noofunitstarget = GetNumber(Slider(5, range=5..20), AtLeast=1, AtMost=1, Maximum=1.797693135e+308, Minimum=-1.797693135e+308, TreeAccess=False)
unitmix_block1__studio = GetNumber(Slider(8, range=5..100), AtLeast=1, AtMost=1, Maximum=1.797693135e+308, Minimum=-1.797693135e+308, TreeAccess=False)
unitmix_block1__2bhk = GetNumber(Slider(6, range=5..100), AtLeast=1, AtMost=1, Maximum=1.797693135e+308, Minimum=-1.797693135e+308, TreeAccess=False)
unitmix_block1__3bhk = GetNumber(Slider(5, range=5..100), AtLeast=1, AtMost=1, Maximum=1.797693135e+308, Minimum=-1.797693135e+308, TreeAccess=False)
offset_6 = OffsetCurve(Curve=item_22, Distance=expr("-x", corridoor_width), Corners=1)
srfsplit = SurfaceSplit(Surface=srf_6, Curves=offset_6)  # -> flatten(Fragments)
noofunits = Data(unitmix_block1_noofunitstarget)
bang_2 = ExplodeTree(Data=graft(srfsplit))  # -> Branch0, Branch1
studio = Data(unitmix_block1__studio)
_2bhk = Data(unitmix_block1__2bhk)
_3bhk = Data(unitmix_block1__3bhk)
sum = Addition(A=studio, B=_2bhk, C=_3bhk)
studioratio = Division(A=studio, B=sum)
_2bhkratio = Division(A=_2bhk, B=sum)
_3bhkratio = Division(A=_3bhk, B=sum)
studiocount = Multiplication(A=noofunits, B=studioratio)
_2bhkcount = Multiplication(A=noofunits, B=_2bhkratio)
_3bhkcount = Multiplication(A=noofunits, B=_3bhkratio)
building_u_curve = Curve(centerline)
studiocount_2 = Round(Number=studiocount)  # -> Nearest, Floor, Ceiling
_2bhkcount_2 = Round(Number=_2bhkcount)  # -> Nearest, Floor, Ceiling
_3bhkcount_2 = Round(Number=_3bhkcount)  # -> Nearest, Floor, Ceiling
studioweight = Multiplication(A="40", B=studiocount_2.Nearest)
_2bhkweight = Multiplication(A="70", B=_2bhkcount_2.Nearest)
_3bhkweight = Multiplication(A="105", B=_3bhkcount_2.Nearest)
len = Length(Curve=building_u_curve)
totalweight = Addition(A=studioweight, B=_2bhkweight, C=_3bhkweight)
division_6 = Division(A=studioweight, B=totalweight)
division_7 = Division(A=_2bhkweight, B=totalweight)
division_8 = Division(A=_3bhkweight, B=totalweight)
striplength_studio = Multiplication(A=len, B=division_6)
striplength_2bhk = Multiplication(A=len, B=division_7)
striplength_3bhk = Multiplication(A=len, B=division_8)
division_9 = Division(A=striplength_studio, B=len)
division_10 = Division(A=striplength_2bhk, B=len)
division_11 = Division(A=striplength_3bhk, B=len)
addition = Addition(A=division_9, B=division_10)
addition_2 = Addition(A=addition, B=division_11)
merge_7 = Merge(Data1=division_9, Data2=addition, Data3=addition_2)  # -> flatten(Result)
ptdivideparam = DivideParameter(Curve=building_u_curve, Param=merge_7, Normalize=True)
curveshatter = CurveShatter(Curve=building_u_curve, Points=ptdivideparam, Tolerance=0.01)
len_2 = Length(Curve=curveshatter)
round = Round(Number=len_2)  # -> Nearest, Floor, Ceiling
round_2 = Round(Number=striplength_studio)  # -> Nearest, Floor, Ceiling
round_3 = Round(Number=len_2)  # -> Nearest, Floor, Ceiling
round_4 = Round(Number=striplength_2bhk)  # -> Nearest, Floor, Ceiling
round_5 = Round(Number=len_2)  # -> Nearest, Floor, Ceiling
round_6 = Round(Number=striplength_3bhk)  # -> Nearest, Floor, Ceiling
equals = Equality(FirstNumber=round.Nearest, SecondNumber=round_2.Nearest)  # -> Equality, Inequality
equals_2 = Equality(FirstNumber=round_3.Nearest, SecondNumber=round_4.Nearest)  # -> Equality, Inequality
equals_3 = Equality(FirstNumber=round_5.Nearest, SecondNumber=round_6.Nearest)  # -> Equality, Inequality
studiocurve = CullPattern(List=curveshatter, CullPattern=equals.Equality)
_2bhkcurve = CullPattern(List=curveshatter, CullPattern=equals_2.Equality)
_3bhkcurve = CullPattern(List=curveshatter, CullPattern=equals_3.Equality)
divide = DivideCurve(Curve=studiocurve, Count=studiocount, Kinks=False)  # -> Points, Tangents, Parameters
divide_2 = DivideCurve(Curve=_2bhkcurve, Count=_2bhkcount, Kinks=False)  # -> Points, Tangents, Parameters
divide_3 = DivideCurve(Curve=_3bhkcurve, Count=_3bhkcount_2.Nearest, Kinks=False)  # -> Points, Tangents, Parameters
midpt = CurveMiddle(Curve=item_21)
vec2pt = Vector2Pt(PointA=midpt, PointB=divide.Points, Unitize=False)  # -> Vector, Length
vec2pt_2 = Vector2Pt(PointA=midpt, PointB=divide_2.Points, Unitize=False)  # -> Vector, Length
vec2pt_3 = Vector2Pt(PointA=midpt, PointB=divide_3.Points, Unitize=False)  # -> Vector, Length
move_6 = Move(Geometry=item_21, Motion=vec2pt.Vector)  # -> Geometry, Transform
move_7 = Move(Geometry=item_21, Motion=vec2pt_2.Vector)  # -> Geometry, Transform
move_8 = Move(Geometry=item_21, Motion=vec2pt_3.Vector)  # -> Geometry, Transform
merge_8 = Merge(Data1=flatten(move_6.Geometry), Data2=flatten(move_7.Geometry), Data3=flatten(move_8.Geometry))
srfsplit_2 = SurfaceSplit(Surface=bang_2.Branch0, Curves=merge_8)
area = Area(Geometry=srfsplit_2)  # -> Area, Centroid
dom = ConstructDomain(DomainStart=0, DomainEnd=1)
bnd = Bounds(Numbers=area.Area)
remap = RemapNumbers(Value=area.Area, Source=bnd, Target=dom)  # -> Mapped, Clipped
number_slider = Slider(0.05, range=0..0.1)
larger = LargerThan(FirstNumber=remap.Mapped, SecondNumber=Slider(0.9, range=0..1))  # -> LargerThan, OrEqualTo
smaller = SmallerThan(FirstNumber=remap.Mapped, SecondNumber=Slider(0.1, range=0..0.1))  # -> SmallerThan, OrEqualTo
cull = CullPattern(List=srfsplit_2, CullPattern=smaller.SmallerThan)
addition_3 = Addition(A=smaller.SmallerThan, B=larger.LargerThan)
cull_2 = CullPattern(List=srfsplit_2, CullPattern=larger.LargerThan)
cull_3 = CullPattern(List=srfsplit_2, CullPattern=invert(addition_3))
offset_7 = OffsetCurve(Curve=bang_2.Branch1, Distance=expr("-x", number_slider), Corners=1)
offset_8 = OffsetCurve(Curve=cull, Distance=expr("-x", number_slider), Corners=1)
offset_9 = OffsetCurve(Curve=cull_3, Distance=expr("-x", number_slider), Corners=1)
offset_10 = OffsetCurve(Curve=cull_2, Distance=expr("-x", number_slider), Corners=1)
mcol_6 = MeshColours(Mesh=offset_7, Colours="#B8B8D1")
mcol_7 = MeshColours(Mesh=offset_8, Colours="#FFC145")
mcol_8 = MeshColours(Mesh=offset_9, Colours="#FF6B6C")
mcol_9 = MeshColours(Mesh=offset_10, Colours="#5B5F97")
mjoin = MeshJoin(Meshes=flatten([mcol_6, mcol_7, mcol_8, mcol_9]))

item_23 = ListItem(List=debrep.Edges, Index=Slider(4, range=0..10), Wrap=True)
activate_license = Activate(FullName="tej", Company="tej", EmailAddress="krishnatejjami@gmail.com")
unit_curves = Curve(simplify(graft(cull_2)))
unit_curves_2 = Curve(simplify(graft(cull_3)))
unit_curves_3 = Curve(simplify(graft(cull)))
eval = EvaluateCurve(Curve=unit_curves, Parameter=Slider(8.8, range=0..100))  # -> Point, Tangent, Angle
eval_2 = EvaluateCurve(Curve=unit_curves_2, Parameter=Slider(28.4, range=0..100))  # -> Point, Tangent, Angle
eval_3 = EvaluateCurve(Curve=unit_curves_3, Parameter=Slider(0, range=0..100))  # -> Point, Tangent, Angle
pt = Point(eval.Point)
pt_2 = Point(eval_2.Point)
pt_3 = Point(eval_3.Point)
fsettings = FitSettings(
    WidthInterior=100,
    WidthExterior=200,
    DownScaling=Slider(0.9, range=0..1),
    UpScaling=1.05,
    ThresholdScore=0,
    AmountOptions=Slider(3, range=0..10),
    UnitSystem=4)

unit_curve = Curve(unit_curves)
entrance_point = Point(pt)
fit = PlanFit(
    Boundary=unit_curve,
    EntranceS=entrance_point,
    Beds=Slider(3, range=0..10),
    Baths=Slider(2, range=0..10),
    Country=26,
    FitSettings=fsettings,
    InHousePlans=False)
item_24 = ListItem(List=fit, Index=Slider(0, range=0..5), Wrap=True)
deplan = DeconstructPlan(Plan=item_24)  # -> InteriorWalls, ExteriorWalls, DoorCurves, Glass, WindowFrames, Furniture, Score, Rooms
deroom = DeconstructRoom(Room=simplify(graft(deplan.Rooms)))  # -> Boundary, InteriorBoundary, Function

fsettings_2 = FitSettings(
    WidthInterior=100,
    WidthExterior=200,
    DownScaling=Slider(0.9, range=0..1),
    UpScaling=1.05,
    ThresholdScore=0,
    AmountOptions=Slider(3, range=0..10),
    UnitSystem=4)

unit_curve_2 = Curve(unit_curves_2)
entrance_point_2 = Point(pt_2)
fit_2 = PlanFit(
    Boundary=unit_curve_2,
    EntranceS=entrance_point_2,
    Beds=Slider(2, range=0..10),
    Baths=Slider(0, range=0..10),
    Country=26,
    FitSettings=fsettings_2,
    InHousePlans=False)
item_25 = ListItem(List=fit_2, Index=Slider(0, range=0..5), Wrap=True)
deplan_2 = DeconstructPlan(Plan=item_25)  # -> InteriorWalls, ExteriorWalls, DoorCurves, Glass, WindowFrames, Furniture, Score, Rooms
deroom_2 = DeconstructRoom(Room=simplify(graft(deplan_2.Rooms)))  # -> Boundary, InteriorBoundary, Function

fsettings_3 = FitSettings(
    WidthInterior=100,
    WidthExterior=200,
    DownScaling=Slider(0.4, range=0..1),
    UpScaling=1.05,
    ThresholdScore=0,
    AmountOptions=Slider(3, range=0..10),
    UnitSystem=4)

unit_curve_3 = Curve(unit_curves_3)
entrance_point_3 = Point(pt_3)
fit_3 = PlanFit(
    Boundary=unit_curve_3,
    EntranceS=entrance_point_3,
    Beds=Slider(0, range=0..10),
    Baths=Slider(1, range=0..10),
    Country=26,
    FitSettings=fsettings_3,
    InHousePlans=False)
item_26 = ListItem(List=fit_3, Index=Slider(0, range=0..5), Wrap=True)
deplan_3 = DeconstructPlan(Plan=item_26)  # -> InteriorWalls, ExteriorWalls, DoorCurves, Glass, WindowFrames, Furniture, Score, Rooms
deroom_3 = DeconstructRoom(Room=simplify(graft(deplan_3.Rooms)))  # -> Boundary, InteriorBoundary, Function

crv = Curve(deplan.Furniture)

# ---- group: Handling site geometry
panel_2 = Panel("0.000,0.000,0.000;21.358,76.880,0.000;95.524,57.799,0.000;73.303,-17.185,0.000;0.000,0.000,0.000")
envelope_vertices = GetString(panel_2, AtLeast=1, AtMost=1, TreeAccess=False)
envelope_setback = GetNumber(Slider(6, range=2..10), AtLeast=1, AtMost=1, Maximum=1.797693135e+308, Minimum=-1.797693135e+308, TreeAccess=False)
envelope_vertices_2 = Data(envelope_vertices)
envelope_setback_2 = Data(envelope_setback)
tmatch_2 = MatchText(Text=envelope_vertices_2, Pattern="0", Case=True)
gate_7 = StreamGate(Stream=envelope_vertices_2, Gate=tmatch_2)  # -> Target0, Target1
split_3 = TextSplit(Text=gate_7.Target0, Separators=";")
pline_2 = PolyLine(Vertices=split_3, Closed=True)
srf_7 = Surface(pline_2)
offset_11 = OffsetCurve(Curve=pline_2, Distance=expr("-x", envelope_setback_2), Corners=1)
srfsplit_3 = SurfaceSplit(Surface=srf_7, Curves=offset_11)

# ----
gate_8 = StreamGate(Stream=srf_7, Gate=massing_mode_2)  # -> Target0, Target1

# ---- group: Handling site geometry (continued)
mcol_10 = MeshColours(Mesh=gate_8.Target1, Colours=ColourSwatch(SwatchColor=RGB(167, 232, 70)))
merge_9 = Merge(Data2=mcol_10)

# ----
mjoin_2 = MeshJoin(Meshes=flatten([merge_9, merge_6, mjoin]))

# ---- group: RH_OUT:meshout
mesh = Mesh(mjoin_2)
