# Grasshopper definition test_main_2.gh (Grasshopper 1.0.8)

panel = Panel("0.000,0.000,0.000;-89.385,34.715,0.000;-81.269,100.487,0.000;24.752,36.130,0.000;0.000,0.000,0.000")
no_of_floors = GetNumber(Slider(7, range=0..10), AtLeast=1, AtMost=1, Maximum=1.797693135e+308, Minimum=-1.797693135e+308, TreeAccess=False)
floor_height = GetNumber(Slider(4, range=0..10), AtLeast=1, AtMost=1, Maximum=1.797693135e+308, Minimum=-1.797693135e+308, TreeAccess=False)
block_vertices = GetString("5.770,21.467,0.000;-65.426,53.208,0.000", AtLeast=1, AtMost=1, TreeAccess=False)
envelope_vertices = GetString(panel, AtLeast=1, AtMost=1, TreeAccess=False)
envelope_setback = GetNumber(Slider(6, range=2..10), AtLeast=1, AtMost=1, Maximum=1.797693135e+308, Minimum=-1.797693135e+308, TreeAccess=False)
block_width = GetNumber(Slider(3, range=0..100), AtLeast=1, AtMost=1, Maximum=1.797693135e+308, Minimum=-1.797693135e+308, TreeAccess=False)
no_of_floors_2 = Data(no_of_floors)
floor_height_2 = Data(floor_height)
envelope_vertices_2 = Data(envelope_vertices)
envelope_setback_2 = Data(envelope_setback)
block_vertices_2 = Data(block_vertices)
block_width_2 = Data(block_width)
series = Series(Start=floor_height_2, Step=floor_height_2, Count=no_of_floors_2)
multiplication = Multiplication(A=floor_height_2, B=no_of_floors_2)
tmatch = MatchText(Text=block_vertices_2, Pattern="0", Case=True)
tmatch_2 = MatchText(Text=envelope_vertices_2, Pattern="0", Case=True)
Z = UnitZ(Factor=series)
gate = StreamGate(Stream=block_vertices_2, Gate=tmatch)  # -> Target0, Target1
gate_2 = StreamGate(Stream=envelope_vertices_2, Gate=tmatch_2)  # -> Target0, Target1
split = TextSplit(Text=gate.Target0, Separators="/")
split_2 = TextSplit(Text=gate_2.Target0, Separators=";")
split_3 = TextSplit(Text=split, Separators=";")
pline = PolyLine(Vertices=split_2, Closed=True)
pline_2 = PolyLine(Vertices=split_3, Closed=False)
srf = Surface(pline)
offset = OffsetCurve(Curve=pline, Distance=expr("-x", envelope_setback_2), Corners=1)
neg = Negative(Value=block_width_2)
offset_2 = OffsetCurve(Curve=pline_2, Distance=[block_width_2, neg], Corners=1)
srfsplit = SurfaceSplit(Surface=srf, Curves=offset)
pshift = ShiftPaths(Data=offset_2, Offset=-1)
end = EndPoints(Curve=pshift)  # -> Start, End
item = ListItem(List=end.Start, Index=0, Wrap=True)
item_2 = ListItem(List=end.Start, Index=1, Wrap=True)
item_3 = ListItem(List=end.End, Index=0, Wrap=True)
item_4 = ListItem(List=end.End, Index=1, Wrap=True)
mcol = MeshColours(Mesh=srf, Colours=ColourSwatch(SwatchColor=RGB(167, 232, 70)))
ln = Line(StartPoint=item, EndPoint=item_2)
ln_2 = Line(StartPoint=item_3, EndPoint=item_4)
merge = Merge(Data1=ln, Data2=ln_2, Data3=pshift)
join = JoinCurves(Curves=merge, Preserve=False)
Z_2 = UnitZ(Factor=multiplication)
srf_2 = Surface(join)
extr = Extrude(Base=srf_2, Direction=Z_2)
lng = ListLength(List=flatten(extr))
series_2 = Series(Start=0, Step=1, Count=lng)
split_4 = TextSplit(Text="#fde2e2,#e8eaf6,#ede7f6,#e3f2fd,#fbe9e7,#e0f7fa,#f1f8e9", Separators=",")
item_5 = ListItem(List=split_4, Index=series_2, Wrap=True)
mcol_2 = MeshColours(Mesh=extr, Colours=graft(item_5))
mjoin = MeshJoin(Meshes=flatten([mcol, mcol_2]))

# ---- group: RH_OUT:meshout
mesh = Mesh(mjoin)
