# Grasshopper definition test_main_4.gh (Grasshopper 1.0.8)
# plug-ins: Pufferfish, PlanFinderGH

# ---- group: Getting all block vertices
panel = Panel("13.859,0.845,0.000;30.838,71.884,0.000/30.297,6.495,0.000;69.197,-2.978,0.000/68.814,12.691,0.000;77.334,51.550,0.000/66.474,52.697,0.000;42.235,57.528,0.000")
envelope_block_vertices = GetString(panel, AtLeast=1, AtMost=1, TreeAccess=False)
block_vertices = Data(envelope_block_vertices)
tmatch = MatchText(Text=block_vertices, Pattern="0", Case=True)
gate = StreamGate(Stream=block_vertices, Gate=tmatch)  # -> Target0, Target1
split = TextSplit(Text=gate.Target0, Separators="/")
split_2 = TextSplit(Text=split, Separators=";")
pline = PolyLine(Vertices=split_2, Closed=False)

# ----
envelope_mode = GetNumber(Slider(2, range=0..4), AtLeast=1, AtMost=1, Maximum=1.797693135e+308, Minimum=-1.797693135e+308, TreeAccess=False)
massing_mode = Equality(FirstNumber=envelope_mode, SecondNumber="0")  # -> Equality, Inequality
unitmix = Equality(FirstNumber=envelope_mode, SecondNumber="1")  # -> Equality, Inequality
floorplan = Equality(FirstNumber=envelope_mode, SecondNumber="2")  # -> Equality, Inequality
facade = Equality(FirstNumber=envelope_mode, SecondNumber="3")  # -> Equality, Inequality
data = Data(unitmix.Equality)
bang = ExplodeTree(Data=pline)  # -> Branch0, Branch1, Branch2, Branch3, Branch4, Branch5, Branch6, Branch7, Branch8, Branch9
massing_mode_2 = Boolean(massing_mode.Equality)
block3_type = GetNumber(Slider(0, range=0..1), AtLeast=1, AtMost=1, Maximum=1.797693135e+308, Minimum=-1.797693135e+308, TreeAccess=False)
block4_type = GetNumber(Slider(0, range=0..1), AtLeast=1, AtMost=1, Maximum=1.797693135e+308, Minimum=-1.797693135e+308, TreeAccess=False)
block5_type = GetNumber(Slider(0, range=0..1), AtLeast=1, AtMost=1, Maximum=1.797693135e+308, Minimum=-1.797693135e+308, TreeAccess=False)
activate_license = Activate(FullName="tej", Company="tej", EmailAddress="krishnatejjami@gmail.com")

fsettings = FitSettings(
    WidthInterior=100,
    WidthExterior=200,
    DownScaling=Slider(0.5, range=0..1),
    UpScaling=1.05,
    ThresholdScore=0,
    AmountOptions=Slider(1, range=0..10),
    UnitSystem=4)

fsettings_2 = FitSettings(
    WidthInterior=100,
    WidthExterior=200,
    DownScaling=Slider(0.5, range=0..1),
    UpScaling=1.05,
    ThresholdScore=0,
    AmountOptions=Slider(1, range=0..10),
    UnitSystem=4)

fsettings_3 = FitSettings(
    WidthInterior=100,
    WidthExterior=200,
    DownScaling=Slider(0.5, range=0..1),
    UpScaling=1.05,
    ThresholdScore=0,
    AmountOptions=Slider(1, range=0..10),
    UnitSystem=4)

# ---- group: Handling site geometry
panel_2 = Panel("0.000,0.000,0.000;19.332,80.378,0.000;96.658,59.012,0.000;77.835,-20.349,0.000;0.000,0.000,0.000")
envelope_vertices = GetString(panel_2, AtLeast=1, AtMost=1, TreeAccess=False)
envelope_setback = GetNumber(Slider(6, range=2..10), AtLeast=1, AtMost=1, Maximum=1.797693135e+308, Minimum=-1.797693135e+308, TreeAccess=False)
envelope_vertices_2 = Data(envelope_vertices)
envelope_setback_2 = Data(envelope_setback)
tmatch_2 = MatchText(Text=envelope_vertices_2, Pattern="0", Case=True)
gate_2 = StreamGate(Stream=envelope_vertices_2, Gate=tmatch_2)  # -> Target0, Target1
split_3 = TextSplit(Text=gate_2.Target0, Separators=";")
pline_2 = PolyLine(Vertices=split_3, Closed=True)
srf = Surface(pline_2)
offset = OffsetCurve(Curve=pline_2, Distance=expr("-x", envelope_setback_2), Corners=1)
srfsplit = SurfaceSplit(Surface=srf, Curves=offset)

# ----
gate_3 = StreamGate(Stream=srf, Gate=massing_mode_2)  # -> Target0, Target1

# ---- group: Handling site geometry (continued)
mcol = MeshColours(Mesh=gate_3.Target1, Colours=ColourSwatch(SwatchColor=RGB(161, 171, 145)))
merge = Merge(Data2=mcol)

# ----
gate_4 = StreamGate(Stream=pline_2, Gate=floorplan.Equality)  # -> Target0, Target1
site_polyline = Data(gate_4.Target1)
area = Area(Geometry=site_polyline)  # -> Area, Centroid
pop2d = Populate2D(Region=site_polyline, Count=100, Seed=1)
offset_2 = OffsetCurve(Curve=site_polyline, Distance=expr("-x", Slider(2, range=0..10)), Corners=1)
dom = ConstructDomain(DomainStart=Slider(2, range=0..100), DomainEnd=Slider(3, range=0..10))
Z = UnitZ(Factor=Slider(0.1, range=0..0.1))
neg = Negative(Value="1")
number_slider = Slider(0.02, range=0..0.02)
Z_2 = UnitZ(Factor=Slider(0.1, range=0..0.1))
swatch = ColourSwatch(SwatchColor=RGB(117, 96, 89))
mcol_2 = MeshColours(Mesh=offset_2, Colours=ColourSwatch(SwatchColor=RGBA(147, 178, 145, 170)))

block2_width = GetNumber(Slider(14, range=8..20), AtLeast=1, AtMost=1, Maximum=1.797693135e+308, Minimum=-1.797693135e+308, TreeAccess=False)
block2_no_of_floors = GetNumber(Slider(3, range=0..10), AtLeast=1, AtMost=1, Maximum=1.797693135e+308, Minimum=-1.797693135e+308, TreeAccess=False)
block2_floor_height = GetNumber(Slider(3, range=0..10), AtLeast=1, AtMost=1, Maximum=1.797693135e+308, Minimum=-1.797693135e+308, TreeAccess=False)
block2_curve = Data(bang.Branch1)
no_of_floors = Data(block2_no_of_floors)
block_width = Data(block2_width)
floor_height = Data(block2_floor_height)
division = Division(A=block_width, B="2")
multiplication = Multiplication(A=floor_height, B=no_of_floors)
series = Series(Start=floor_height, Step=floor_height, Count=no_of_floors)
neg_2 = Negative(Value=division)
Z_3 = UnitZ(Factor=series)
offset_3 = OffsetCurve(Curve=block2_curve, Distance=[division, neg_2], Corners=1)
pshift = ShiftPaths(Data=offset_3, Offset=-1)
end = EndPoints(Curve=pshift)  # -> Start, End
item = ListItem(List=end.Start, Index=0, Wrap=True)
item_2 = ListItem(List=end.Start, Index=1, Wrap=True)
item_3 = ListItem(List=end.End, Index=0, Wrap=True)
item_4 = ListItem(List=end.End, Index=1, Wrap=True)
ln = Line(StartPoint=item, EndPoint=item_2)
ln_2 = Line(StartPoint=item_3, EndPoint=item_4)
merge_2 = Merge(Data1=ln, Data2=ln_2, Data3=pshift)
join = JoinCurves(Curves=merge_2, Preserve=False)
Z_4 = UnitZ(Factor=multiplication)
srf_2 = Surface(join)
gate_5 = StreamGate(Stream=srf_2, Gate=massing_mode_2)  # -> Target0, Target1
block2_type = GetNumber(Slider(0, range=0..1), AtLeast=1, AtMost=1, Maximum=1.797693135e+308, Minimum=-1.797693135e+308, TreeAccess=False)
extr = Extrude(Base=gate_5.Target1, Direction=Z_4)
Z_5 = UnitZ(Factor=Slider(0.01, range=0..0.01))
move = Move(Geometry=extr, Motion=Z_5)  # -> Geometry, Transform

block3_curve = Data(bang.Branch2)
block3_width = GetNumber(Slider(8, range=8..20), AtLeast=1, AtMost=1, Maximum=1.797693135e+308, Minimum=-1.797693135e+308, TreeAccess=False)
block3_no_of_floors = GetNumber(Slider(3, range=0..10), AtLeast=1, AtMost=1, Maximum=1.797693135e+308, Minimum=-1.797693135e+308, TreeAccess=False)
block3_floor_height = GetNumber(Slider(3, range=0..10), AtLeast=1, AtMost=1, Maximum=1.797693135e+308, Minimum=-1.797693135e+308, TreeAccess=False)
no_of_floors_2 = Data(block3_no_of_floors)
block_width_2 = Data(block3_width)
floor_height_2 = Data(block3_floor_height)
division_2 = Division(A=block_width_2, B="2")
multiplication_2 = Multiplication(A=floor_height_2, B=no_of_floors_2)
series_2 = Series(Start=floor_height_2, Step=floor_height_2, Count=no_of_floors_2)
neg_3 = Negative(Value=division_2)
Z_6 = UnitZ(Factor=series_2)
offset_4 = OffsetCurve(Curve=block3_curve, Distance=[division_2, neg_3], Corners=1)
pshift_2 = ShiftPaths(Data=offset_4, Offset=-1)
end_2 = EndPoints(Curve=pshift_2)  # -> Start, End
item_5 = ListItem(List=end_2.Start, Index=0, Wrap=True)
item_6 = ListItem(List=end_2.Start, Index=1, Wrap=True)
item_7 = ListItem(List=end_2.End, Index=0, Wrap=True)
item_8 = ListItem(List=end_2.End, Index=1, Wrap=True)
ln_3 = Line(StartPoint=item_5, EndPoint=item_6)
ln_4 = Line(StartPoint=item_7, EndPoint=item_8)
merge_3 = Merge(Data1=ln_3, Data2=ln_4, Data3=pshift_2)
join_2 = JoinCurves(Curves=merge_3, Preserve=False)
Z_7 = UnitZ(Factor=multiplication_2)
srf_3 = Surface(join_2)
gate_6 = StreamGate(Stream=srf_3, Gate=massing_mode_2)  # -> Target0, Target1
extr_2 = Extrude(Base=gate_6.Target1, Direction=Z_7)
Z_8 = UnitZ(Factor=Slider(0.01, range=0..0.01))
move_2 = Move(Geometry=extr_2, Motion=Z_8)  # -> Geometry, Transform

block4_curve = Data(bang.Branch3)
block4_width = GetNumber(Slider(8, range=0..100), AtLeast=1, AtMost=1, Maximum=1.797693135e+308, Minimum=-1.797693135e+308, TreeAccess=False)
block4_no_of_floors = GetNumber(Slider(3, range=0..10), AtLeast=1, AtMost=1, Maximum=1.797693135e+308, Minimum=-1.797693135e+308, TreeAccess=False)
block4_floor_height = GetNumber(Slider(3, range=0..10), AtLeast=1, AtMost=1, Maximum=1.797693135e+308, Minimum=-1.797693135e+308, TreeAccess=False)
block_width_3 = Data(block4_width)
no_of_floors_3 = Data(block4_no_of_floors)
floor_height_3 = Data(block4_floor_height)
division_3 = Division(A=block_width_3, B="2")
multiplication_3 = Multiplication(A=floor_height_3, B=no_of_floors_3)
series_3 = Series(Start=floor_height_3, Step=floor_height_3, Count=no_of_floors_3)
neg_4 = Negative(Value=division_3)
Z_9 = UnitZ(Factor=series_3)
offset_5 = OffsetCurve(Curve=block4_curve, Distance=[division_3, neg_4], Corners=1)
pshift_3 = ShiftPaths(Data=offset_5, Offset=-1)
end_3 = EndPoints(Curve=pshift_3)  # -> Start, End
item_9 = ListItem(List=end_3.Start, Index=0, Wrap=True)
item_10 = ListItem(List=end_3.Start, Index=1, Wrap=True)
item_11 = ListItem(List=end_3.End, Index=0, Wrap=True)
item_12 = ListItem(List=end_3.End, Index=1, Wrap=True)
ln_5 = Line(StartPoint=item_9, EndPoint=item_10)
ln_6 = Line(StartPoint=item_11, EndPoint=item_12)
merge_4 = Merge(Data1=ln_5, Data2=ln_6, Data3=pshift_3)
join_3 = JoinCurves(Curves=merge_4, Preserve=False)
Z_10 = UnitZ(Factor=multiplication_3)
srf_4 = Surface(join_3)
gate_7 = StreamGate(Stream=srf_4, Gate=massing_mode_2)  # -> Target0, Target1
extr_3 = Extrude(Base=gate_7.Target1, Direction=Z_10)
Z_11 = UnitZ(Factor=Slider(0.01, range=0..0.01))
move_3 = Move(Geometry=extr_3, Motion=Z_11)  # -> Geometry, Transform

block5_curve = Data(bang.Branch4)
block5_width = GetNumber(Slider(8, range=0..100), AtLeast=1, AtMost=1, Maximum=1.797693135e+308, Minimum=-1.797693135e+308, TreeAccess=False)
block5_no_of_floors = GetNumber(Slider(3, range=0..10), AtLeast=1, AtMost=1, Maximum=1.797693135e+308, Minimum=-1.797693135e+308, TreeAccess=False)
block5_floor_height = GetNumber(Slider(3, range=0..10), AtLeast=1, AtMost=1, Maximum=1.797693135e+308, Minimum=-1.797693135e+308, TreeAccess=False)
block_width_4 = Data(block5_width)
no_of_floors_4 = Data(block5_no_of_floors)
floor_height_4 = Data(block5_floor_height)
division_4 = Division(A=block_width_4, B="2")
multiplication_4 = Multiplication(A=floor_height_4, B=no_of_floors_4)
series_4 = Series(Start=floor_height_4, Step=floor_height_4, Count=no_of_floors_4)
neg_5 = Negative(Value=division_4)
Z_12 = UnitZ(Factor=series_4)
offset_6 = OffsetCurve(Curve=block5_curve, Distance=[division_4, neg_5], Corners=1)
pshift_4 = ShiftPaths(Data=offset_6, Offset=-1)
end_4 = EndPoints(Curve=pshift_4)  # -> Start, End
item_13 = ListItem(List=end_4.Start, Index=0, Wrap=True)
item_14 = ListItem(List=end_4.Start, Index=1, Wrap=True)
item_15 = ListItem(List=end_4.End, Index=0, Wrap=True)
item_16 = ListItem(List=end_4.End, Index=1, Wrap=True)
ln_7 = Line(StartPoint=item_13, EndPoint=item_14)
ln_8 = Line(StartPoint=item_15, EndPoint=item_16)
merge_5 = Merge(Data1=ln_7, Data2=ln_8, Data3=pshift_4)
join_4 = JoinCurves(Curves=merge_5, Preserve=False)
Z_13 = UnitZ(Factor=multiplication_4)
srf_5 = Surface(join_4)
gate_8 = StreamGate(Stream=srf_5, Gate=massing_mode_2)  # -> Target0, Target1
extr_4 = Extrude(Base=gate_8.Target1, Direction=Z_13)
Z_14 = UnitZ(Factor=Slider(0.01, range=0..0.01))
move_4 = Move(Geometry=extr_4, Motion=Z_14)  # -> Geometry, Transform

block1_width = GetNumber(Slider(14, range=8..20), AtLeast=1, AtMost=1, Maximum=1.797693135e+308, Minimum=-1.797693135e+308, TreeAccess=False)
block1_no_of_floors = GetNumber(Slider(5, range=2..10), AtLeast=1, AtMost=1, Maximum=1.797693135e+308, Minimum=-1.797693135e+308, TreeAccess=False)
block1_floor_height = GetNumber(Slider(3, range=3..5), AtLeast=1, AtMost=1, Maximum=1.797693135e+308, Minimum=-1.797693135e+308, TreeAccess=False)
block1_curve = Data(bang.Branch0)
floor_height_5 = Data(block1_floor_height)
block_width_5 = Data(block1_width)
no_of_floors_5 = Data(block1_no_of_floors)
multiplication_5 = Multiplication(A=floor_height_5, B=no_of_floors_5)
series_5 = Series(Start=floor_height_5, Step=floor_height_5, Count=no_of_floors_5)
division_5 = Division(A=block_width_5, B="2")
neg_6 = Negative(Value=division_5)
Z_15 = UnitZ(Factor=series_5)
offset_7 = OffsetCurve(Curve=block1_curve, Distance=[division_5, neg_6], Corners=1)
pshift_5 = ShiftPaths(Data=offset_7, Offset=-1)
end_5 = EndPoints(Curve=pshift_5)  # -> Start, End
item_17 = ListItem(List=end_5.Start, Index=0, Wrap=True)
item_18 = ListItem(List=end_5.Start, Index=1, Wrap=True)
item_19 = ListItem(List=end_5.End, Index=0, Wrap=True)
item_20 = ListItem(List=end_5.End, Index=1, Wrap=True)
ln_9 = Line(StartPoint=item_17, EndPoint=item_18)
ln_10 = Line(StartPoint=item_19, EndPoint=item_20)
merge_6 = Merge(Data1=ln_9, Data2=ln_10, Data3=pshift_5)
join_5 = JoinCurves(Curves=merge_6, Preserve=False)
Z_16 = UnitZ(Factor=multiplication_5)
srf_6 = Surface(join_5)
gate_9 = StreamGate(Stream=srf_6, Gate=massing_mode_2)  # -> Target0, Target1
extr_5 = Extrude(Base=gate_9.Target1, Direction=Z_16)
Z_17 = UnitZ(Factor=Slider(0.01, range=0..0.01))
move_5 = Move(Geometry=extr_5, Motion=Z_17)  # -> Geometry, Transform

merge_7 = Merge(Data1=srf_6, Data2=srf_2, Data3=srf_3, Data4=srf_4)
area_2 = Area(Geometry=merge_7)  # -> Area, Centroid
building_polyline = Data(merge_7)
offset_8 = OffsetCurve(Curve=building_polyline, Distance=Slider(2, range=0..10), Corners=1)  # -> flatten(Curve)
ln_11 = Line(StartPoint=area.Centroid, EndPoint=area_2.Centroid)
incurves = PointInCurves(Point=pop2d, Curves=offset_8)  # -> Relationship, Index, Point
cull = CullPattern(List=pop2d, CullPattern=invert(incurves.Relationship))
lng = ListLength(List=cull)
random = Random(Range=dom, Number=lng, Seed=2)
extr_6 = Extrude(Base=offset_8, Direction=Z)
Z_18 = UnitZ(Factor=random)
cap = CapHoles(Brep=extr_6)
move_6 = Move(Geometry=cull, Motion=Z_18)  # -> Geometry, Transform
offset_9 = OffsetCurve(Curve=ln_11, Distance=["1", neg], Corners=1)
division_6 = Division(A=random, B=Slider(2.5, range=0..10))
pshift_6 = ShiftPaths(Data=offset_9, Offset=-1)
rectangle = Rectangle(Plane=cull, XSize=number_slider, YSize=number_slider, Radius=0)  # -> Rectangle, Length
division_7 = Division(A=Z_18, B=Slider(1.3, range=0..10))
end_6 = EndPoints(Curve=pshift_6)  # -> Start, End
extr_7 = Extrude(Base=rectangle.Rectangle, Direction=division_7)
item_21 = ListItem(List=end_6.Start, Index=0, Wrap=True)
item_22 = ListItem(List=end_6.Start, Index=1, Wrap=True)
item_23 = ListItem(List=end_6.End, Index=0, Wrap=True)
item_24 = ListItem(List=end_6.End, Index=1, Wrap=True)
sph = Sphere(Base=move_6.Geometry, Radius=division_6)
ln_12 = Line(StartPoint=item_21, EndPoint=item_22)
ln_13 = Line(StartPoint=item_23, EndPoint=item_24)
merge_8 = Merge(Data1=ln_12, Data2=ln_13, Data3=pshift_6)
join_6 = JoinCurves(Curves=merge_8, Preserve=False)
extr_8 = Extrude(Base=join_6, Direction=Z_2)
cap_2 = CapHoles(Brep=extr_8)
mcol_3 = MeshColours(Mesh=cap_2, Colours=swatch)
mcol_4 = MeshColours(Mesh=cap, Colours=swatch)
mcol_5 = MeshColours(Mesh=cap, Colours=ColourSwatch(SwatchColor=RGB(117, 96, 89)))
mcol_6 = MeshColours(Mesh=sph, Colours=ColourSwatch(SwatchColor=RGBA(73, 130, 69, 170)))
mcol_7 = MeshColours(Mesh=extr_7, Colours=ColourSwatch(SwatchColor=RGB(117, 96, 89)))

filter = StreamFilter(Gate=block2_type, Stream0="#276FBF", Stream1="#83B692")
mcol_8 = MeshColours(Mesh=move.Geometry, Colours=graft(filter))

filter_2 = StreamFilter(Gate=block3_type, Stream0="#276FBF", Stream1="#83B692")
filter_3 = StreamFilter(Gate=block4_type, Stream0="#276FBF", Stream1="#83B692")
filter_4 = StreamFilter(Gate=block5_type, Stream0="#276FBF", Stream1="#83B692")

mcol_9 = MeshColours(Mesh=move_2.Geometry, Colours=graft(filter_2))

mcol_10 = MeshColours(Mesh=move_3.Geometry, Colours=graft(filter_3))

mcol_11 = MeshColours(Mesh=move_4.Geometry, Colours=graft(filter_4))

mjoin = MeshJoin(Meshes=[mcol_3, mcol_4, mcol_2, mcol_5, mcol_6, mcol_7])
filter_5 = StreamFilter(Gate=floorplan.Equality, Stream1=mjoin)

block1_corridoor = GetNumber(Slider(2, range=2..4), AtLeast=1, AtMost=1, Maximum=1.797693135e+308, Minimum=-1.797693135e+308, TreeAccess=False)
centerline = Curve(block1_curve)
corridoor_width = Data(block1_corridoor)
srf_7 = Surface(gate_9.Target0)
block_width_6 = Data(block_width_5)
larger = LargerThan(FirstNumber=block_width_6, SecondNumber="11")  # -> LargerThan, OrEqualTo
division_8 = Division(A=block_width_6, B=2)
gate_10 = StreamGate(Stream=centerline, Gate=larger.LargerThan)  # -> Target0, Target1
cp = ControlPoints(Curve=centerline)  # -> Points, Weights, Knots
lng_2 = ListLength(List=cp.Points)
panel_3 = Panel("""0
-1""")
larger_2 = LargerThan(FirstNumber=lng_2, SecondNumber="2")  # -> LargerThan, OrEqualTo
division_9 = Division(A=block_width_6, B=2)
division_10 = Division(A=corridoor_width, B=2)
neg_7 = Negative(Value=division_8)
cull_i = CullIndex(List=cp.Points, Indices=panel_3, Wrap=True)
filter_6 = StreamFilter(Gate=larger_2.LargerThan, Stream0=centerline)
neg_8 = Negative(Value=division_10)
offset_10 = OffsetCurve(Curve=graft(filter_6), Distance=[neg_7, division_8], Corners=1)
neg_9 = Negative(Value=division_9)
cir = Circle(Plane=cull_i, Radius=division_8)
offset_11 = OffsetCurve(Curve=gate_10.Target0, Distance=[neg_9, division_9], Corners=1)  # -> flatten(Curve)
offset_12 = OffsetCurve(Curve=gate_10.Target1, Distance=[neg_8, division_10], Corners=1)
end_7 = EndPoints(Curve=offset_10)  # -> Start, End
trim = TrimWithRegion(Curve=centerline, Region=cir)  # -> Inside, Outside
bang_2 = ExplodeTree(Data=end_7.Start)  # -> _00000, _00001, Branch2, Branch3, Branch4, Branch5, Branch6, Branch7
bang_3 = ExplodeTree(Data=end_7.End)  # -> _00000, _00001, Branch2, Branch3, Branch4, Branch5, Branch6, Branch7
end_8 = EndPoints(Curve=offset_12)  # -> Start, End
item_25 = ListItem(List=offset_11, Index=Slider(0, range=0..1), Wrap=True)
bang_4 = ExplodeTree(Data=end_8.Start)  # -> _0000, _0001
bang_5 = ExplodeTree(Data=end_8.End)  # -> _0000, _0001
ln_14 = Line(StartPoint=bang_2._00000, EndPoint=bang_2._00001)
ln_15 = Line(StartPoint=bang_2.Branch2, EndPoint=bang_2.Branch3)
ln_16 = Line(StartPoint=bang_2.Branch4, EndPoint=bang_2.Branch5)
ln_17 = Line(StartPoint=bang_2.Branch6, EndPoint=bang_2.Branch7)
ln_18 = Line(StartPoint=bang_3._00000, EndPoint=bang_3._00001)
ln_19 = Line(StartPoint=bang_3.Branch2, EndPoint=bang_3.Branch3)
ln_20 = Line(StartPoint=bang_3.Branch4, EndPoint=bang_3.Branch5)
ln_21 = Line(StartPoint=bang_3.Branch6, EndPoint=bang_3.Branch7)
neg_10 = Negative(Value=corridoor_width)
ln_22 = Line(StartPoint=bang_4._0000, EndPoint=bang_4._0001)
ln_23 = Line(StartPoint=bang_5._0000, EndPoint=bang_5._0001)
merge_9 = Merge(
    Data1=flatten(ln_14),
    Data2=flatten(ln_15),
    Data3=flatten(ln_18),
    Data4=flatten(ln_19),
    Data5=flatten(offset_10),
    Data6=flatten(ln_20),
    Data7=flatten(ln_21),
    Data8=flatten(ln_16),
    Data9=flatten(ln_17))
offset_13 = OffsetCurve(Curve=item_25, Distance=[neg_10, corridoor_width], Corners=1)
merge_10 = Merge(Data1=ln_14, Data2=ln_21, Data3=ln_18, Data4=ln_15, Data5=ln_19, Data6=ln_17, Data7=ln_20)  # -> flatten(Result)
entwine = Entwine(Branch00=ln_22, Branch01=ln_23, Branch02=offset_12, FlattenInputs=True)  # -> flatten(Result)
merge_11 = Merge(Data1=ln_14, Data2=ln_21)  # -> flatten(Result)
larger_3 = LargerThan(FirstNumber=lng_2, SecondNumber="2")  # -> LargerThan, OrEqualTo
midpt = CurveMiddle(Curve=offset_13)
join_7 = JoinCurves(Curves=merge_9, Preserve=False)
join_8 = JoinCurves(Curves=entwine, Preserve=False)
incurve = PointInCurve(Point=midpt, Curve=srf_7)  # -> Relationship, Point
filter_7 = StreamFilter(Gate=larger_3.LargerThan, Stream0=merge_10)
cull_2 = CullPattern(List=offset_13, CullPattern=incurve.Relationship)
end_9 = EndPoints(Curve=cull_2)  # -> Start, End
end_10 = EndPoints(Curve=item_25)  # -> Start, End
ln_24 = Line(StartPoint=end_9.Start, EndPoint=end_10.Start)
ln_25 = Line(StartPoint=end_9.End, EndPoint=end_10.End)
entwine_2 = Entwine(Branch00=ln_24, Branch01=ln_25, Branch02=cull_2, Branch03=item_25, FlattenInputs=True)  # -> flatten(Result)
join_9 = JoinCurves(Curves=entwine_2, Preserve=False)
flip = FlipMatrix(Data=filter_7)
bang_6 = ExplodeTree(Data=flip)  # -> Branch0, Branch1, Branch2
number_slider_2 = Slider(3, range=0..10)
item_26 = ListItem(List=filter_7, Index=0, Wrap=True)
item_27 = ListItem(List=filter_7, Index=1, Wrap=True)
block1_noofunits = GetNumber(Slider(10, range=5..20), AtLeast=1, AtMost=1, Maximum=1.797693135e+308, Minimum=-1.797693135e+308, TreeAccess=False)
merge_12 = Merge(Data1=item_26, Data2=bang_6.Branch0)  # -> flatten(Result)
merge_13 = Merge(Data1=bang_6.Branch0, Data2=bang_6.Branch1)  # -> flatten(Result)
merge_14 = Merge(Data1=bang_6.Branch1, Data2=item_27)  # -> flatten(Result)
midpt_2 = CurveMiddle(Curve=merge_14)
midpt_3 = CurveMiddle(Curve=merge_12)
midpt_4 = CurveMiddle(Curve=merge_13)
series_6 = Series(Start=0, Step=1, Count=expr("x+1", block1_noofunits))
pline_3 = PolyLine(Vertices=midpt_2, Closed=False)
pline_4 = PolyLine(Vertices=midpt_3, Closed=False)
series_7 = Series(Start=0, Step=1, Count=expr("x+1", block1_noofunits))
series_8 = Series(Start=0, Step=1, Count=expr("x+1", block1_noofunits))
bnd = Bounds(Numbers=series_6)
dom_2 = ConstructDomain(DomainStart=0, DomainEnd=1)
pline_5 = PolyLine(Vertices=midpt_4, Closed=False)
bnd_2 = Bounds(Numbers=series_8)
bnd_3 = Bounds(Numbers=series_7)
dom_3 = ConstructDomain(DomainStart=0, DomainEnd=1)
dom_4 = ConstructDomain(DomainStart=0, DomainEnd=1)
remap = RemapNumbers(Value=series_6, Source=bnd, Target=dom_2)  # -> Mapped, Clipped
remap_2 = RemapNumbers(Value=series_8, Source=bnd_2, Target=dom_3)  # -> Mapped, Clipped
remap_3 = RemapNumbers(Value=series_7, Source=bnd_3, Target=dom_4)  # -> Mapped, Clipped
twnthrucrvscrv = TweenThroughCurvesAlongCurve(Curves=merge_12, Guide1=pline_4, Factor=remap.Mapped, Normalized=True, Equalized=False, Refit=0, PointSample=0)
twnthrucrvscrv_2 = TweenThroughCurvesAlongCurve(Curves=merge_13, Guide1=pline_5, Factor=remap_2.Mapped, Normalized=True, Equalized=True, Refit=0, PointSample=0)
twnthrucrvscrv_3 = TweenThroughCurvesAlongCurve(Curves=merge_14, Guide1=pline_3, Factor=remap_3.Mapped, Normalized=True, Equalized=True, Refit=0, PointSample=0)
merge_15 = Merge(Data1=join_8, Data2=join_9)
merge_16 = Merge(Data1=flatten(twnthrucrvscrv), Data2=flatten(twnthrucrvscrv_2), Data3=flatten(twnthrucrvscrv_3), Data4=flatten(merge_15))
srfsplit_2 = SurfaceSplit(Surface=join_7, Curves=merge_16)
area_3 = Area(Geometry=srfsplit_2)  # -> Area, Centroid
incurve_2 = PointInCurve(Point=area_3.Centroid, Curve=merge_15)  # -> Relationship, Point
filter_8 = StreamFilter(Gate=larger.LargerThan, Stream0="2.3", Stream1="2.5")
cull_3 = CullPattern(List=srfsplit_2, CullPattern=invert(incurve_2.Relationship))
number_slider_3 = Slider(7, range=0..10)
debrep = DeconstructBrep(Brep=cull_3)  # -> Faces, Edges, Vertices
division_11 = Division(A=block_width_6, B=filter_8)
midpt_5 = CurveMiddle(Curve=debrep.Edges)
offset_14 = OffsetCurve(Curve=merge_15, Distance=1, Corners=1)
offset_15 = OffsetCurve(Curve=merge_15, Distance=division_11, Corners=1)
incurve_3 = PointInCurve(Point=midpt_5, Curve=offset_15)  # -> Relationship, Point
incurve_4 = PointInCurve(Point=midpt_5, Curve=offset_14)  # -> Relationship, Point
cull_4 = CullPattern(List=debrep.Edges, CullPattern=incurve_4.Relationship)  # -> flatten(List)
equals = Equality(FirstNumber=incurve_3.Relationship, SecondNumber="0")  # -> Equality, Inequality
cull_5 = CullPattern(List=debrep.Edges, CullPattern=equals.Equality)  # -> flatten(List)
midpt_6 = CurveMiddle(Curve=cull_4)
midpt_7 = CurveMiddle(Curve=cull_5)
room = Curve(flatten(cull_3))
entrance = Point(flatten(midpt_6))
facade_2 = Curve(flatten(cull_5))
facade_curves = Curve(simplify(graft(facade_2)))
panel_4 = Panel("0")
ln_26 = Line(StartPoint=midpt_6, EndPoint=midpt_7)
Z_19 = UnitZ(Factor=1)

filter_9 = StreamFilter(Gate=larger.LargerThan, Stream0="#276FBF", Stream1="#83B692")
mcol_12 = MeshColours(Mesh=move_5.Geometry, Colours=graft(filter_9))

# ---- group: Massing stage
merge_17 = Merge(Data1=mcol_12, Data2=mcol_8, Data3=mcol_9, Data4=mcol_10, Data5=mcol_11)

# ----
block2_corridoor = GetNumber(Slider(2, range=2..4), AtLeast=1, AtMost=1, Maximum=1.797693135e+308, Minimum=-1.797693135e+308, TreeAccess=False)
block_width_7 = Data(block_width)
centerline_2 = Curve(block2_curve)
corridoor_width_2 = Data(block2_corridoor)
srf_8 = Surface(gate_5.Target0)
larger_4 = LargerThan(FirstNumber=block_width_7, SecondNumber="11")  # -> LargerThan, OrEqualTo
division_12 = Division(A=block_width_7, B=2)
gate_11 = StreamGate(Stream=centerline_2, Gate=larger_4.LargerThan)  # -> Target0, Target1
cp_2 = ControlPoints(Curve=centerline_2)  # -> Points, Weights, Knots
lng_3 = ListLength(List=cp_2.Points)
panel_5 = Panel("""0
-1""")
larger_5 = LargerThan(FirstNumber=lng_3, SecondNumber="2")  # -> LargerThan, OrEqualTo
division_13 = Division(A=block_width_7, B=2)
division_14 = Division(A=corridoor_width_2, B=2)
neg_11 = Negative(Value=division_12)
cull_i_2 = CullIndex(List=cp_2.Points, Indices=panel_5, Wrap=True)
filter_10 = StreamFilter(Gate=larger_5.LargerThan, Stream0=centerline_2)
neg_12 = Negative(Value=division_14)
offset_16 = OffsetCurve(Curve=graft(filter_10), Distance=[neg_11, division_12], Corners=1)
neg_13 = Negative(Value=division_13)
cir_2 = Circle(Plane=cull_i_2, Radius=division_12)
offset_17 = OffsetCurve(Curve=gate_11.Target0, Distance=[neg_13, division_13], Corners=1)  # -> flatten(Curve)
offset_18 = OffsetCurve(Curve=gate_11.Target1, Distance=[neg_12, division_14], Corners=1)
end_11 = EndPoints(Curve=offset_16)  # -> Start, End
trim_2 = TrimWithRegion(Curve=centerline_2, Region=cir_2)  # -> Inside, Outside
bang_7 = ExplodeTree(Data=end_11.Start)  # -> _00100, _00101, Branch2, Branch3, Branch4, Branch5, Branch6, Branch7
bang_8 = ExplodeTree(Data=end_11.End)  # -> _00100, _00101, Branch2, Branch3, Branch4, Branch5, Branch6, Branch7
end_12 = EndPoints(Curve=offset_18)  # -> Start, End
item_28 = ListItem(List=offset_17, Index=Slider(0, range=0..1), Wrap=True)
bang_9 = ExplodeTree(Data=end_12.Start)  # -> _0010, _0011
bang_10 = ExplodeTree(Data=end_12.End)  # -> _0010, _0011
ln_27 = Line(StartPoint=bang_7._00100, EndPoint=bang_7._00101)
ln_28 = Line(StartPoint=bang_7.Branch2, EndPoint=bang_7.Branch3)
ln_29 = Line(StartPoint=bang_7.Branch4, EndPoint=bang_7.Branch5)
ln_30 = Line(StartPoint=bang_7.Branch6, EndPoint=bang_7.Branch7)
ln_31 = Line(StartPoint=bang_8._00100, EndPoint=bang_8._00101)
ln_32 = Line(StartPoint=bang_8.Branch2, EndPoint=bang_8.Branch3)
ln_33 = Line(StartPoint=bang_8.Branch4, EndPoint=bang_8.Branch5)
ln_34 = Line(StartPoint=bang_8.Branch6, EndPoint=bang_8.Branch7)
neg_14 = Negative(Value=corridoor_width_2)
ln_35 = Line(StartPoint=bang_9._0010, EndPoint=bang_9._0011)
ln_36 = Line(StartPoint=bang_10._0010, EndPoint=bang_10._0011)
merge_18 = Merge(
    Data1=flatten(ln_27),
    Data2=flatten(ln_28),
    Data3=flatten(ln_31),
    Data4=flatten(ln_32),
    Data5=flatten(offset_16),
    Data6=flatten(ln_33),
    Data7=flatten(ln_34),
    Data8=flatten(ln_29),
    Data9=flatten(ln_30))
offset_19 = OffsetCurve(Curve=item_28, Distance=[neg_14, corridoor_width_2], Corners=1)
merge_19 = Merge(Data1=ln_27, Data2=ln_34, Data3=ln_31, Data4=ln_28, Data5=ln_32, Data6=ln_30, Data7=ln_33)  # -> flatten(Result)
entwine_3 = Entwine(Branch00=ln_35, Branch01=ln_36, Branch02=offset_18, FlattenInputs=True)  # -> flatten(Result)
merge_20 = Merge(Data1=ln_27, Data2=ln_34)  # -> flatten(Result)
larger_6 = LargerThan(FirstNumber=lng_3, SecondNumber="2")  # -> LargerThan, OrEqualTo
midpt_8 = CurveMiddle(Curve=offset_19)
join_10 = JoinCurves(Curves=merge_18, Preserve=False)
join_11 = JoinCurves(Curves=entwine_3, Preserve=False)
incurve_5 = PointInCurve(Point=midpt_8, Curve=srf_8)  # -> Relationship, Point
filter_11 = StreamFilter(Gate=larger_6.LargerThan, Stream0=merge_19)
cull_6 = CullPattern(List=offset_19, CullPattern=incurve_5.Relationship)
end_13 = EndPoints(Curve=cull_6)  # -> Start, End
end_14 = EndPoints(Curve=item_28)  # -> Start, End
ln_37 = Line(StartPoint=end_13.Start, EndPoint=end_14.Start)
ln_38 = Line(StartPoint=end_13.End, EndPoint=end_14.End)
entwine_4 = Entwine(Branch00=ln_37, Branch01=ln_38, Branch02=cull_6, Branch03=item_28, FlattenInputs=True)  # -> flatten(Result)
join_12 = JoinCurves(Curves=entwine_4, Preserve=False)
flip_2 = FlipMatrix(Data=filter_11)
bang_11 = ExplodeTree(Data=flip_2)  # -> Branch0, Branch1, Branch2
number_slider_4 = Slider(3, range=0..10)
item_29 = ListItem(List=filter_11, Index=0, Wrap=True)
item_30 = ListItem(List=filter_11, Index=1, Wrap=True)
block2_noofunits = GetNumber(Slider(8, range=5..20), AtLeast=1, AtMost=1, Maximum=1.797693135e+308, Minimum=-1.797693135e+308, TreeAccess=False)
merge_21 = Merge(Data1=item_29, Data2=bang_11.Branch0)  # -> flatten(Result)
merge_22 = Merge(Data1=bang_11.Branch0, Data2=bang_11.Branch1)  # -> flatten(Result)
merge_23 = Merge(Data1=bang_11.Branch1, Data2=item_30)  # -> flatten(Result)
midpt_9 = CurveMiddle(Curve=merge_23)
midpt_10 = CurveMiddle(Curve=merge_21)
midpt_11 = CurveMiddle(Curve=merge_22)
series_9 = Series(Start=0, Step=1, Count=expr("x+1", block2_noofunits))
pline_6 = PolyLine(Vertices=midpt_9, Closed=False)
pline_7 = PolyLine(Vertices=midpt_10, Closed=False)
series_10 = Series(Start=0, Step=1, Count=expr("x+1", block2_noofunits))
series_11 = Series(Start=0, Step=1, Count=expr("x+1", block2_noofunits))
bnd_4 = Bounds(Numbers=series_9)
dom_5 = ConstructDomain(DomainStart=0, DomainEnd=1)
pline_8 = PolyLine(Vertices=midpt_11, Closed=False)
bnd_5 = Bounds(Numbers=series_11)
bnd_6 = Bounds(Numbers=series_10)
dom_6 = ConstructDomain(DomainStart=0, DomainEnd=1)
dom_7 = ConstructDomain(DomainStart=0, DomainEnd=1)
remap_4 = RemapNumbers(Value=series_9, Source=bnd_4, Target=dom_5)  # -> Mapped, Clipped
remap_5 = RemapNumbers(Value=series_11, Source=bnd_5, Target=dom_6)  # -> Mapped, Clipped
remap_6 = RemapNumbers(Value=series_10, Source=bnd_6, Target=dom_7)  # -> Mapped, Clipped
twnthrucrvscrv_4 = TweenThroughCurvesAlongCurve(Curves=merge_21, Guide1=pline_7, Factor=remap_4.Mapped, Normalized=True, Equalized=False, Refit=0, PointSample=0)
twnthrucrvscrv_5 = TweenThroughCurvesAlongCurve(Curves=merge_22, Guide1=pline_8, Factor=remap_5.Mapped, Normalized=True, Equalized=True, Refit=0, PointSample=0)
twnthrucrvscrv_6 = TweenThroughCurvesAlongCurve(Curves=merge_23, Guide1=pline_6, Factor=remap_6.Mapped, Normalized=True, Equalized=True, Refit=0, PointSample=0)
merge_24 = Merge(Data1=join_11, Data2=join_12)
merge_25 = Merge(
    Data1=flatten(twnthrucrvscrv_4),
    Data2=flatten(twnthrucrvscrv_5),
    Data3=flatten(twnthrucrvscrv_6),
    Data4=flatten(merge_24))
srfsplit_3 = SurfaceSplit(Surface=join_10, Curves=merge_25)
area_4 = Area(Geometry=srfsplit_3)  # -> Area, Centroid
incurve_6 = PointInCurve(Point=area_4.Centroid, Curve=merge_24)  # -> Relationship, Point
filter_12 = StreamFilter(Gate=larger_4.LargerThan, Stream0="2.3", Stream1="2.5")
cull_7 = CullPattern(List=srfsplit_3, CullPattern=invert(incurve_6.Relationship))
number_slider_5 = Slider(7, range=0..10)
debrep_2 = DeconstructBrep(Brep=cull_7)  # -> Faces, Edges, Vertices
division_15 = Division(A=block_width_7, B=filter_12)
midpt_12 = CurveMiddle(Curve=debrep_2.Edges)
offset_20 = OffsetCurve(Curve=merge_24, Distance=1, Corners=1)
offset_21 = OffsetCurve(Curve=merge_24, Distance=division_15, Corners=1)
incurve_7 = PointInCurve(Point=midpt_12, Curve=offset_21)  # -> Relationship, Point
incurve_8 = PointInCurve(Point=midpt_12, Curve=offset_20)  # -> Relationship, Point
cull_8 = CullPattern(List=debrep_2.Edges, CullPattern=incurve_8.Relationship)  # -> flatten(List)
equals_2 = Equality(FirstNumber=incurve_7.Relationship, SecondNumber="0")  # -> Equality, Inequality
cull_9 = CullPattern(List=debrep_2.Edges, CullPattern=equals_2.Equality)  # -> flatten(List)
midpt_13 = CurveMiddle(Curve=cull_8)
midpt_14 = CurveMiddle(Curve=cull_9)
room_2 = Curve(flatten(cull_7))
entrance_2 = Point(flatten(midpt_13))
facade_3 = Curve(flatten(cull_9))
facade_curves_2 = Curve(simplify(graft(facade_3)))
ln_39 = Line(StartPoint=midpt_13, EndPoint=midpt_14)
Z_20 = UnitZ(Factor=1)

block3_corridoor = GetNumber(Slider(2, range=2..4), AtLeast=1, AtMost=1, Maximum=1.797693135e+308, Minimum=-1.797693135e+308, TreeAccess=False)
block_width_8 = Data(block_width_2)
centerline_3 = Curve(block3_curve)
corridoor_width_3 = Data(block3_corridoor)
srf_9 = Surface(gate_6.Target0)
larger_7 = LargerThan(FirstNumber=block_width_8, SecondNumber="11")  # -> LargerThan, OrEqualTo
division_16 = Division(A=block_width_8, B=2)
gate_12 = StreamGate(Stream=centerline_3, Gate=larger_7.LargerThan)  # -> Target0, Target1
cp_3 = ControlPoints(Curve=centerline_3)  # -> Points, Weights, Knots
lng_4 = ListLength(List=cp_3.Points)
panel_7 = Panel("""0
-1""")
larger_8 = LargerThan(FirstNumber=lng_4, SecondNumber="2")  # -> LargerThan, OrEqualTo
division_17 = Division(A=block_width_8, B=2)
division_18 = Division(A=corridoor_width_3, B=2)
neg_15 = Negative(Value=division_16)
cull_i_3 = CullIndex(List=cp_3.Points, Indices=panel_7, Wrap=True)
filter_13 = StreamFilter(Gate=larger_8.LargerThan, Stream0=centerline_3)
neg_16 = Negative(Value=division_18)
offset_22 = OffsetCurve(Curve=graft(filter_13), Distance=[neg_15, division_16], Corners=1)
neg_17 = Negative(Value=division_17)
cir_3 = Circle(Plane=cull_i_3, Radius=division_16)
offset_23 = OffsetCurve(Curve=gate_12.Target0, Distance=[neg_17, division_17], Corners=1)  # -> flatten(Curve)
offset_24 = OffsetCurve(Curve=gate_12.Target1, Distance=[neg_16, division_18], Corners=1)
end_15 = EndPoints(Curve=offset_22)  # -> Start, End
trim_3 = TrimWithRegion(Curve=centerline_3, Region=cir_3)  # -> Inside, Outside
bang_12 = ExplodeTree(Data=end_15.Start)  # -> _00200, _00201, Branch2, Branch3, Branch4, Branch5, Branch6, Branch7
bang_13 = ExplodeTree(Data=end_15.End)  # -> _00200, _00201, Branch2, Branch3, Branch4, Branch5, Branch6, Branch7
end_16 = EndPoints(Curve=offset_24)  # -> Start, End
item_31 = ListItem(List=offset_23, Index=Slider(0, range=0..1), Wrap=True)
bang_14 = ExplodeTree(Data=end_16.Start)  # -> Branch0, Branch1
bang_15 = ExplodeTree(Data=end_16.End)  # -> Branch0, Branch1
ln_40 = Line(StartPoint=bang_12._00200, EndPoint=bang_12._00201)
ln_41 = Line(StartPoint=bang_12.Branch2, EndPoint=bang_12.Branch3)
ln_42 = Line(StartPoint=bang_12.Branch4, EndPoint=bang_12.Branch5)
ln_43 = Line(StartPoint=bang_12.Branch6, EndPoint=bang_12.Branch7)
ln_44 = Line(StartPoint=bang_13._00200, EndPoint=bang_13._00201)
ln_45 = Line(StartPoint=bang_13.Branch2, EndPoint=bang_13.Branch3)
ln_46 = Line(StartPoint=bang_13.Branch4, EndPoint=bang_13.Branch5)
ln_47 = Line(StartPoint=bang_13.Branch6, EndPoint=bang_13.Branch7)
neg_18 = Negative(Value=corridoor_width_3)
ln_48 = Line(StartPoint=bang_14.Branch0, EndPoint=bang_14.Branch1)
ln_49 = Line(StartPoint=bang_15.Branch0, EndPoint=bang_15.Branch1)
merge_26 = Merge(
    Data1=flatten(ln_40),
    Data2=flatten(ln_41),
    Data3=flatten(ln_44),
    Data4=flatten(ln_45),
    Data5=flatten(offset_22),
    Data6=flatten(ln_46),
    Data7=flatten(ln_47),
    Data8=flatten(ln_42),
    Data9=flatten(ln_43))
offset_25 = OffsetCurve(Curve=item_31, Distance=[neg_18, corridoor_width_3], Corners=1)
merge_27 = Merge(Data1=ln_40, Data2=ln_47, Data3=ln_44, Data4=ln_41, Data5=ln_45, Data6=ln_43, Data7=ln_46)  # -> flatten(Result)
entwine_5 = Entwine(Branch00=ln_48, Branch01=ln_49, Branch02=offset_24, FlattenInputs=True)  # -> flatten(Result)
merge_28 = Merge(Data1=ln_40, Data2=ln_47)  # -> flatten(Result)
larger_9 = LargerThan(FirstNumber=lng_4, SecondNumber="2")  # -> LargerThan, OrEqualTo
midpt_15 = CurveMiddle(Curve=offset_25)
join_13 = JoinCurves(Curves=merge_26, Preserve=False)
join_14 = JoinCurves(Curves=entwine_5, Preserve=False)
incurve_9 = PointInCurve(Point=midpt_15, Curve=srf_9)  # -> Relationship, Point
filter_14 = StreamFilter(Gate=larger_9.LargerThan, Stream0=merge_27)
cull_10 = CullPattern(List=offset_25, CullPattern=incurve_9.Relationship)
end_17 = EndPoints(Curve=cull_10)  # -> Start, End
end_18 = EndPoints(Curve=item_31)  # -> Start, End
ln_50 = Line(StartPoint=end_17.Start, EndPoint=end_18.Start)
ln_51 = Line(StartPoint=end_17.End, EndPoint=end_18.End)
entwine_6 = Entwine(Branch00=ln_50, Branch01=ln_51, Branch02=cull_10, Branch03=item_31, FlattenInputs=True)  # -> flatten(Result)
join_15 = JoinCurves(Curves=entwine_6, Preserve=False)
flip_3 = FlipMatrix(Data=filter_14)
bang_16 = ExplodeTree(Data=flip_3)  # -> Branch0, Branch1, Branch2
number_slider_6 = Slider(3, range=0..10)
item_32 = ListItem(List=filter_14, Index=0, Wrap=True)
item_33 = ListItem(List=filter_14, Index=1, Wrap=True)
block3_noofunits = GetNumber(Slider(8, range=5..20), AtLeast=1, AtMost=1, Maximum=1.797693135e+308, Minimum=-1.797693135e+308, TreeAccess=False)
merge_29 = Merge(Data1=item_32, Data2=bang_16.Branch0)  # -> flatten(Result)
merge_30 = Merge(Data1=bang_16.Branch0, Data2=bang_16.Branch1)  # -> flatten(Result)
merge_31 = Merge(Data1=bang_16.Branch1, Data2=item_33)  # -> flatten(Result)
midpt_16 = CurveMiddle(Curve=merge_31)
midpt_17 = CurveMiddle(Curve=merge_29)
midpt_18 = CurveMiddle(Curve=merge_30)
series_12 = Series(Start=0, Step=1, Count=expr("x+1", block3_noofunits))
pline_9 = PolyLine(Vertices=midpt_16, Closed=False)
pline_10 = PolyLine(Vertices=midpt_17, Closed=False)
series_13 = Series(Start=0, Step=1, Count=expr("x+1", block3_noofunits))
series_14 = Series(Start=0, Step=1, Count=expr("x+1", block3_noofunits))
bnd_7 = Bounds(Numbers=series_12)
dom_8 = ConstructDomain(DomainStart=0, DomainEnd=1)
pline_11 = PolyLine(Vertices=midpt_18, Closed=False)
bnd_8 = Bounds(Numbers=series_14)
bnd_9 = Bounds(Numbers=series_13)
dom_9 = ConstructDomain(DomainStart=0, DomainEnd=1)
dom_10 = ConstructDomain(DomainStart=0, DomainEnd=1)
remap_7 = RemapNumbers(Value=series_12, Source=bnd_7, Target=dom_8)  # -> Mapped, Clipped
remap_8 = RemapNumbers(Value=series_14, Source=bnd_8, Target=dom_9)  # -> Mapped, Clipped
remap_9 = RemapNumbers(Value=series_13, Source=bnd_9, Target=dom_10)  # -> Mapped, Clipped
twnthrucrvscrv_7 = TweenThroughCurvesAlongCurve(Curves=merge_29, Guide1=pline_10, Factor=remap_7.Mapped, Normalized=True, Equalized=False, Refit=0, PointSample=0)
twnthrucrvscrv_8 = TweenThroughCurvesAlongCurve(Curves=merge_30, Guide1=pline_11, Factor=remap_8.Mapped, Normalized=True, Equalized=True, Refit=0, PointSample=0)
twnthrucrvscrv_9 = TweenThroughCurvesAlongCurve(Curves=merge_31, Guide1=pline_9, Factor=remap_9.Mapped, Normalized=True, Equalized=True, Refit=0, PointSample=0)
merge_32 = Merge(Data1=join_14, Data2=join_15)
merge_33 = Merge(
    Data1=flatten(twnthrucrvscrv_7),
    Data2=flatten(twnthrucrvscrv_8),
    Data3=flatten(twnthrucrvscrv_9),
    Data4=flatten(merge_32))
srfsplit_4 = SurfaceSplit(Surface=join_13, Curves=merge_33)
area_5 = Area(Geometry=srfsplit_4)  # -> Area, Centroid
incurve_10 = PointInCurve(Point=area_5.Centroid, Curve=merge_32)  # -> Relationship, Point
filter_15 = StreamFilter(Gate=larger_7.LargerThan, Stream0="2.3", Stream1="2.5")
cull_11 = CullPattern(List=srfsplit_4, CullPattern=invert(incurve_10.Relationship))
number_slider_7 = Slider(7, range=0..10)
debrep_3 = DeconstructBrep(Brep=cull_11)  # -> Faces, Edges, Vertices
division_19 = Division(A=block_width_8, B=filter_15)
midpt_19 = CurveMiddle(Curve=debrep_3.Edges)
offset_26 = OffsetCurve(Curve=merge_32, Distance=1, Corners=1)
offset_27 = OffsetCurve(Curve=merge_32, Distance=division_19, Corners=1)
incurve_11 = PointInCurve(Point=midpt_19, Curve=offset_27)  # -> Relationship, Point
incurve_12 = PointInCurve(Point=midpt_19, Curve=offset_26)  # -> Relationship, Point
cull_12 = CullPattern(List=debrep_3.Edges, CullPattern=incurve_12.Relationship)  # -> flatten(List)
equals_3 = Equality(FirstNumber=incurve_11.Relationship, SecondNumber="0")  # -> Equality, Inequality
cull_13 = CullPattern(List=debrep_3.Edges, CullPattern=equals_3.Equality)  # -> flatten(List)
midpt_20 = CurveMiddle(Curve=cull_12)
midpt_21 = CurveMiddle(Curve=cull_13)
room_3 = Curve(flatten(cull_11))
entrance_3 = Point(flatten(midpt_20))
facade_4 = Curve(flatten(cull_13))
facade_curves_3 = Curve(simplify(graft(facade_4)))
ln_52 = Line(StartPoint=midpt_20, EndPoint=midpt_21)
Z_21 = UnitZ(Factor=1)

entrance_point = Point(simplify(graft(entrance)))
unit_curves = Curve(simplify(graft(room)))
fit = PlanFit(
    Boundary=unit_curves,
    EntranceS=entrance_point,
    FacadeS=facade_curves,
    Beds=Slider(1, range=0..10),
    Baths=-1,
    Country=26,
    FitSettings=fsettings,
    InHousePlans=False)

entrance_point_2 = Point(simplify(graft(entrance_3)))
unit_curves_2 = Curve(simplify(graft(room_3)))
fit_2 = PlanFit(
    Boundary=unit_curves_2,
    EntranceS=entrance_point_2,
    FacadeS=facade_curves_3,
    Beds=Slider(1, range=0..10),
    Baths=-1,
    Country=26,
    FitSettings=fsettings_3,
    InHousePlans=False)

unit_curves_3 = Curve(simplify(graft(room_2)))
entrance_point_3 = Point(simplify(graft(entrance_2)))
fit_3 = PlanFit(
    Boundary=unit_curves_3,
    EntranceS=entrance_point_3,
    FacadeS=facade_curves_2,
    Beds=Slider(1, range=0..10),
    Baths=-1,
    Country=26,
    FitSettings=fsettings_2,
    InHousePlans=False)

clean = CleanTree(RemoveNulls=True, RemoveInvalid=True, RemoveEmpty=True, Tree=fit)

item_34 = ListItem(List=clean, Index=Slider(0, range=0..5), Wrap=True)
deplan = DeconstructPlan(Plan=item_34)  # -> InteriorWalls, ExteriorWalls, DoorCurves, Glass, WindowFrames, Furniture, Score, Rooms

group = NamedGroup(Geometry=deplan.InteriorWalls, Name="IW")  # -> Group, Geometry, Name
group_2 = NamedGroup(Geometry=deplan.ExteriorWalls, Name="EW")  # -> Group, Geometry, Name
group_3 = NamedGroup(Geometry=deplan.WindowFrames, Name="W")  # -> Group, Geometry, Name
group_4 = NamedGroup(Geometry=deplan.Furniture, Name="F")  # -> Group, Geometry, Name
group_5 = NamedGroup(Geometry=deplan.DoorCurves, Name="D")  # -> Group, Geometry, Name
group_6 = Group(Geometry=[group.Group, group_2.Group, group_5.Group, group_3.Group, group_4.Group])
lng_5 = ListLength(List=flatten(group_6))
series_15 = Series(Start=0, Step=1, Count=lng_5)
mod = Modulus(A=series_15, B="2")
dispatch = Dispatch(List=flatten(group_6), DispatchPattern=mod)  # -> ListA, ListB
dispatch_2 = Dispatch(List=flatten(ln_26), DispatchPattern=mod)  # -> ListA, ListB
x = Data(dispatch_2.ListA)
midpt_22 = CurveMiddle(Curve=dispatch_2.ListA)
data_2 = Data(dispatch.ListA)
pl = ConstructPlane(Origin=midpt_22, XAxis=x, YAxis=Z_19)
mirror = Mirror(Geometry=data_2, Plane=pl)  # -> Geometry, Transform
data_3 = Data(dispatch.ListB)

clean_2 = CleanTree(RemoveNulls=True, RemoveInvalid=True, RemoveEmpty=True, Tree=fit_3)

item_35 = ListItem(List=clean_2, Index=Slider(0, range=0..5), Wrap=True)
deplan_2 = DeconstructPlan(Plan=item_35)  # -> InteriorWalls, ExteriorWalls, DoorCurves, Glass, WindowFrames, Furniture, Score, Rooms

group_7 = NamedGroup(Geometry=deplan_2.InteriorWalls, Name="IW")  # -> Group, Geometry, Name
group_8 = NamedGroup(Geometry=deplan_2.ExteriorWalls, Name="EW")  # -> Group, Geometry, Name
group_9 = NamedGroup(Geometry=deplan_2.WindowFrames, Name="W")  # -> Group, Geometry, Name
group_10 = NamedGroup(Geometry=deplan_2.Furniture, Name="F")  # -> Group, Geometry, Name
group_11 = NamedGroup(Geometry=deplan_2.DoorCurves, Name="D")  # -> Group, Geometry, Name
group_12 = Group(Geometry=[group_7.Group, group_8.Group, group_11.Group, group_9.Group, group_10.Group])
lng_6 = ListLength(List=flatten(group_12))
series_16 = Series(Start=0, Step=1, Count=lng_6)
mod_2 = Modulus(A=series_16, B="2")
dispatch_3 = Dispatch(List=flatten(group_12), DispatchPattern=mod_2)  # -> ListA, ListB
dispatch_4 = Dispatch(List=flatten(ln_39), DispatchPattern=mod_2)  # -> ListA, ListB
data_4 = Data(dispatch_3.ListA)
x_2 = Data(dispatch_4.ListA)
midpt_23 = CurveMiddle(Curve=dispatch_4.ListA)
pl_2 = ConstructPlane(Origin=midpt_23, XAxis=x_2, YAxis=Z_20)
data_5 = Data(dispatch_3.ListB)
mirror_2 = Mirror(Geometry=data_4, Plane=pl_2)  # -> Geometry, Transform

clean_3 = CleanTree(RemoveNulls=True, RemoveInvalid=True, RemoveEmpty=True, Tree=fit_2)

item_36 = ListItem(List=clean_3, Index=Slider(0, range=0..5), Wrap=True)
deplan_3 = DeconstructPlan(Plan=item_36)  # -> InteriorWalls, ExteriorWalls, DoorCurves, Glass, WindowFrames, Furniture, Score, Rooms

group_13 = NamedGroup(Geometry=deplan_3.InteriorWalls, Name="IW")  # -> Group, Geometry, Name
group_14 = NamedGroup(Geometry=deplan_3.ExteriorWalls, Name="EW")  # -> Group, Geometry, Name
group_15 = NamedGroup(Geometry=deplan_3.WindowFrames, Name="W")  # -> Group, Geometry, Name
group_16 = NamedGroup(Geometry=deplan_3.Furniture, Name="F")  # -> Group, Geometry, Name
group_17 = NamedGroup(Geometry=deplan_3.DoorCurves, Name="D")  # -> Group, Geometry, Name
group_18 = Group(Geometry=[group_13.Group, group_14.Group, group_17.Group, group_15.Group, group_16.Group])
lng_7 = ListLength(List=flatten(group_18))
series_17 = Series(Start=0, Step=1, Count=lng_7)
mod_3 = Modulus(A=series_17, B="2")
dispatch_5 = Dispatch(List=flatten(group_18), DispatchPattern=mod_3)  # -> ListA, ListB
dispatch_6 = Dispatch(List=flatten(ln_52), DispatchPattern=mod_3)  # -> ListA, ListB
data_6 = Data(dispatch_5.ListA)
x_3 = Data(dispatch_6.ListA)
midpt_24 = CurveMiddle(Curve=dispatch_6.ListA)
pl_3 = ConstructPlane(Origin=midpt_24, XAxis=x_3, YAxis=Z_21)
data_7 = Data(dispatch_5.ListB)
mirror_3 = Mirror(Geometry=data_6, Plane=pl_3)  # -> Geometry, Transform

ungroup = Ungroup(Group=data_3)
ungroup_2 = Ungroup(Group=mirror.Geometry)
item_37 = ListItem(List=ungroup, Index=0, Wrap=True)  # -> Item, Item1, Item2, Item3, Item4
item_38 = ListItem(List=ungroup_2, Index=0, Wrap=True)  # -> Item, Item1, Item2, Item3, Item4
ungroup_3 = Ungroup(Group=item_37.Item)
ungroup_4 = Ungroup(Group=item_37.Item1)
ungroup_5 = Ungroup(Group=item_37.Item3)
ungroup_6 = Ungroup(Group=item_37.Item4)
ungroup_7 = Ungroup(Group=item_37.Item2)
ungroup_8 = Ungroup(Group=item_38.Item2)
ungroup_9 = Ungroup(Group=item_38.Item4)
ungroup_10 = Ungroup(Group=item_38.Item)
ungroup_11 = Ungroup(Group=item_38.Item1)
ungroup_12 = Ungroup(Group=item_38.Item3)
mcol_13 = MeshColours(Mesh=ungroup_3, Colours=ColourSwatch(SwatchColor=RGB(0, 0, 0)))
mcol_14 = MeshColours(Mesh=ungroup_4, Colours=ColourSwatch(SwatchColor=RGB(0, 0, 0)))
mcol_15 = MeshColours(Mesh=ungroup_5, Colours=ColourSwatch(SwatchColor=RGBA(28, 236, 255, 129)))
mcol_16 = MeshColours(Mesh=ungroup_12, Colours=ColourSwatch(SwatchColor=RGBA(28, 236, 255, 129)))
mcol_17 = MeshColours(Mesh=ungroup_10, Colours=ColourSwatch(SwatchColor=RGB(0, 0, 0)))
mcol_18 = MeshColours(Mesh=ungroup_11, Colours=ColourSwatch(SwatchColor=RGB(0, 0, 0)))

cls = Closed(Curve=ungroup_6)  # -> Closed, Periodic
cls_2 = Closed(Curve=ungroup_7)  # -> Closed, Periodic
cls_3 = Closed(Curve=ungroup_8)  # -> Closed, Periodic
cull_14 = CullPattern(List=ungroup_6, CullPattern=cls.Closed)
cls_4 = Closed(Curve=ungroup_9)  # -> Closed, Periodic
cull_15 = CullPattern(List=ungroup_7, CullPattern=cls_2.Closed)
cull_16 = CullPattern(List=ungroup_8, CullPattern=cls_3.Closed)
cull_17 = CullPattern(List=ungroup_9, CullPattern=cls_4.Closed)

mesh = Mesh(cull_14)
mesh_2 = Mesh(cull_15)
mcol_19 = MeshColours(Mesh=mesh, Colours=ColourSwatch(SwatchColor=RGBA(153, 153, 153, 103)))
mcol_20 = MeshColours(Mesh=mesh_2, Colours=ColourSwatch(SwatchColor=RGB(255, 28, 28)))
mesh_3 = Mesh(cull_17)
mcol_21 = MeshColours(Mesh=cull_16, Colours=ColourSwatch(SwatchColor=RGB(255, 28, 28)))
mcol_22 = MeshColours(Mesh=mesh_3, Colours=ColourSwatch(SwatchColor=RGBA(153, 153, 153, 103)))
mjoin_2 = MeshJoin(Meshes=[mcol_20, mcol_13, mcol_14, mcol_15, mcol_19, mcol_17, mcol_18, mcol_16, mcol_22, mcol_21])

ungroup_13 = Ungroup(Group=mirror_3.Geometry)
ungroup_14 = Ungroup(Group=data_7)
item_39 = ListItem(List=ungroup_13, Index=0, Wrap=True)  # -> Item, Item1, Item2, Item3, Item4
item_40 = ListItem(List=ungroup_14, Index=0, Wrap=True)  # -> Item, Item1, Item2, Item3, Item4
ungroup_15 = Ungroup(Group=item_39.Item4)
ungroup_16 = Ungroup(Group=item_39.Item)
ungroup_17 = Ungroup(Group=item_39.Item1)
ungroup_18 = Ungroup(Group=item_39.Item3)
ungroup_19 = Ungroup(Group=item_39.Item2)
ungroup_20 = Ungroup(Group=item_40.Item2)
ungroup_21 = Ungroup(Group=item_40.Item)
ungroup_22 = Ungroup(Group=item_40.Item1)
ungroup_23 = Ungroup(Group=item_40.Item3)
ungroup_24 = Ungroup(Group=item_40.Item4)
mcol_23 = MeshColours(Mesh=ungroup_16, Colours=ColourSwatch(SwatchColor=RGB(0, 0, 0)))
mcol_24 = MeshColours(Mesh=ungroup_17, Colours=ColourSwatch(SwatchColor=RGB(0, 0, 0)))
mcol_25 = MeshColours(Mesh=ungroup_18, Colours=ColourSwatch(SwatchColor=RGBA(28, 236, 255, 129)))
mcol_26 = MeshColours(Mesh=ungroup_23, Colours=ColourSwatch(SwatchColor=RGBA(28, 236, 255, 129)))
mcol_27 = MeshColours(Mesh=ungroup_21, Colours=ColourSwatch(SwatchColor=RGB(0, 0, 0)))
mcol_28 = MeshColours(Mesh=ungroup_22, Colours=ColourSwatch(SwatchColor=RGB(0, 0, 0)))

cls_5 = Closed(Curve=ungroup_20)  # -> Closed, Periodic
cls_6 = Closed(Curve=ungroup_15)  # -> Closed, Periodic
cls_7 = Closed(Curve=ungroup_19)  # -> Closed, Periodic
cull_18 = CullPattern(List=ungroup_20, CullPattern=cls_5.Closed)
cull_19 = CullPattern(List=ungroup_15, CullPattern=cls_6.Closed)
cull_20 = CullPattern(List=ungroup_19, CullPattern=cls_7.Closed)
cls_8 = Closed(Curve=ungroup_24)  # -> Closed, Periodic
cull_21 = CullPattern(List=ungroup_24, CullPattern=cls_8.Closed)

mesh_4 = Mesh(cull_19)
mesh_5 = Mesh(cull_20)
mesh_6 = Mesh(cull_18)
mesh_7 = Mesh(cull_21)
mcol_29 = MeshColours(Mesh=mesh_4, Colours=ColourSwatch(SwatchColor=RGBA(153, 153, 153, 103)))
mcol_30 = MeshColours(Mesh=mesh_5, Colours=ColourSwatch(SwatchColor=RGB(255, 28, 28)))
mcol_31 = MeshColours(Mesh=mesh_6, Colours=ColourSwatch(SwatchColor=RGB(255, 28, 28)))
mcol_32 = MeshColours(Mesh=mesh_7, Colours=ColourSwatch(SwatchColor=RGBA(153, 153, 153, 103)))
mjoin_3 = MeshJoin(Meshes=[mcol_30, mcol_23, mcol_24, mcol_25, mcol_29, mcol_27, mcol_28, mcol_26, mcol_32, mcol_31])

ungroup_25 = Ungroup(Group=mirror_2.Geometry)
ungroup_26 = Ungroup(Group=data_5)
item_41 = ListItem(List=ungroup_25, Index=0, Wrap=True)  # -> Item, Item1, Item2, Item3, Item4
item_42 = ListItem(List=ungroup_26, Index=0, Wrap=True)  # -> Item, Item1, Item2, Item3, Item4
ungroup_27 = Ungroup(Group=item_41.Item)
ungroup_28 = Ungroup(Group=item_41.Item1)
ungroup_29 = Ungroup(Group=item_41.Item3)
ungroup_30 = Ungroup(Group=item_41.Item4)
ungroup_31 = Ungroup(Group=item_41.Item2)
ungroup_32 = Ungroup(Group=item_42.Item2)
ungroup_33 = Ungroup(Group=item_42.Item)
ungroup_34 = Ungroup(Group=item_42.Item1)
ungroup_35 = Ungroup(Group=item_42.Item3)
ungroup_36 = Ungroup(Group=item_42.Item4)
mcol_33 = MeshColours(Mesh=ungroup_27, Colours=ColourSwatch(SwatchColor=RGB(0, 0, 0)))
mcol_34 = MeshColours(Mesh=ungroup_28, Colours=ColourSwatch(SwatchColor=RGB(0, 0, 0)))
mcol_35 = MeshColours(Mesh=ungroup_29, Colours=ColourSwatch(SwatchColor=RGBA(28, 236, 255, 129)))
mcol_36 = MeshColours(Mesh=ungroup_35, Colours=ColourSwatch(SwatchColor=RGBA(28, 236, 255, 129)))
mcol_37 = MeshColours(Mesh=ungroup_33, Colours=ColourSwatch(SwatchColor=RGB(0, 0, 0)))
mcol_38 = MeshColours(Mesh=ungroup_34, Colours=ColourSwatch(SwatchColor=RGB(0, 0, 0)))

cls_9 = Closed(Curve=ungroup_32)  # -> Closed, Periodic
cls_10 = Closed(Curve=ungroup_30)  # -> Closed, Periodic
cls_11 = Closed(Curve=ungroup_31)  # -> Closed, Periodic
cls_12 = Closed(Curve=ungroup_36)  # -> Closed, Periodic
cull_22 = CullPattern(List=ungroup_32, CullPattern=cls_9.Closed)
cull_23 = CullPattern(List=ungroup_30, CullPattern=cls_10.Closed)
cull_24 = CullPattern(List=ungroup_31, CullPattern=cls_11.Closed)
cull_25 = CullPattern(List=ungroup_36, CullPattern=cls_12.Closed)

mesh_8 = Mesh(cull_23)
mesh_9 = Mesh(cull_24)
mesh_10 = Mesh(cull_25)
mesh_11 = Mesh(cull_22)
mcol_39 = MeshColours(Mesh=mesh_8, Colours=ColourSwatch(SwatchColor=RGBA(153, 153, 153, 103)))
mcol_40 = MeshColours(Mesh=mesh_9, Colours=ColourSwatch(SwatchColor=RGB(255, 28, 28)))
mcol_41 = MeshColours(Mesh=mesh_10, Colours=ColourSwatch(SwatchColor=RGBA(153, 153, 153, 103)))
mcol_42 = MeshColours(Mesh=mesh_11, Colours=ColourSwatch(SwatchColor=RGB(255, 28, 28)))
mjoin_4 = MeshJoin(Meshes=[mcol_40, mcol_33, mcol_34, mcol_35, mcol_39, mcol_37, mcol_38, mcol_36, mcol_41, mcol_42])

filter_16 = StreamFilter(Gate=data, Stream1=[mjoin_4, mjoin_3, mjoin_2])

floor_height_6 = Data(Z_3)
glass_windows = Data([ungroup_29, ungroup_35])
foorrplate = Data(srf_8)
floor_height_7 = Data(floor_height_5)
total_floor_height = Data(multiplication)
merge_34 = Merge(Data1=ungroup_27, Data2=ungroup_28, Data3=ungroup_33, Data4=ungroup_34)
Z_22 = UnitZ(Factor=floor_height_7)
facade_curves_4 = Data(facade_3)
Z_23 = UnitZ(Factor=total_floor_height)
Z_24 = UnitZ(Factor=Slider(0.15, range=0..1))
debrep_4 = DeconstructBrep(Brep=glass_windows)  # -> Faces, Edges, Vertices
extr_9 = Extrude(Base=foorrplate, Direction=Z_24)
number_slider_8 = Slider(0.05, range=0..0.1)
facade_block2_balconywidth = GetNumber(Slider(1.2, range=0..2), AtLeast=1, AtMost=1, Maximum=1.797693135e+308, Minimum=-1.797693135e+308, TreeAccess=False)
cull_i_4 = CullIndex(List=floor_height_6, Indices="-1", Wrap=True)
item_43 = ListItem(List=debrep_4.Edges, Index=Slider(2, range=0..10), Wrap=True)
extr_10 = Extrude(Base=item_43, Direction=Z_22)  # -> flatten(Extrusion)
facade_block2_balconytype = GetNumber(Slider(0, range=0..3), AtLeast=1, AtMost=1, Maximum=1.797693135e+308, Minimum=-1.797693135e+308, TreeAccess=False)
extr_11 = Extrude(Base=merge_34, Direction=Z_23)
move_7 = Move(Geometry=extr_9, Motion=floor_height_6)  # -> Geometry, Transform
divide = DivideCurve(Curve=item_43, Count=Slider(4, range=0..10), Kinks=False)  # -> Points, Tangents, Parameters
move_8 = Move(Geometry=facade_curves_4, Motion=graft(cull_i_4))  # -> Geometry, Transform
pl_4 = ConstructPlane(Origin=divide.Points, XAxis=item_43, YAxis=Vector(0, 1, 0))
gate_13 = StreamGate(Stream=move_8.Geometry, Gate=facade_block2_balconytype)  # -> Target0, Target1, Target2, Target3
move_9 = Move(Geometry=extr_10, Motion=graft(cull_i_4))  # -> Geometry, Transform
rectangle_2 = Rectangle(Plane=pl_4, XSize=number_slider_8, YSize=number_slider_8, Radius=0)  # -> Rectangle, Length
extr_12 = Extrude(Base=rectangle_2.Rectangle, Direction=Z_22)  # -> flatten(Extrusion)
move_10 = Move(Geometry=extr_12, Motion=graft(cull_i_4))  # -> Geometry, Transform
swatch_2 = ColourSwatch(SwatchColor=RGB(163, 163, 163))
facade_curves_5 = Data(gate_13.Target2)
mcol_43 = MeshColours(Mesh=extr_11, Colours=swatch_2)
mcol_44 = MeshColours(Mesh=move_7.Geometry, Colours=swatch_2)
mcol_45 = MeshColours(Mesh=[move_9.Geometry, extr_10], Colours=ColourSwatch(SwatchColor=RGBA(138, 201, 207, 46)))
mcol_46 = MeshColours(Mesh=[move_10.Geometry, extr_12], Colours=ColourSwatch(SwatchColor=RGBA(0, 0, 0, 63)))
offset_28 = OffsetCurve(Curve=facade_curves_5, Distance=expr("-x", facade_block2_balconywidth), Corners=1)
end_19 = EndPoints(Curve=facade_curves_5)  # -> Start, End
midpt_25 = CurveMiddle(Curve=offset_28)
pshift_7 = ShiftPaths(Data=midpt_25, Offset=-1)
ln_53 = Line(StartPoint=pshift_7, EndPoint=end_19.End)
ln_54 = Line(StartPoint=pshift_7, EndPoint=end_19.Start)
join_16 = JoinCurves(Curves=[ln_53, ln_54], Preserve=False)
Z_25 = UnitZ(Factor=1)
extr_13 = Extrude(Base=join_16, Direction=Z_25)

facade_curves_6 = Data(gate_13.Target1)
offset_29 = OffsetCurve(Curve=facade_curves_6, Distance=expr("-x", facade_block2_balconywidth), Corners=1)
midpt_26 = CurveMiddle(Curve=offset_29)
rotate = Rotate(Geometry=offset_29, Angle=degrees(Slider(16, range=-20..20)), Plane=midpt_26)  # -> Geometry, Transform
pshift_8 = ShiftPaths(Data=rotate.Geometry, Offset=-1)
end_20 = EndPoints(Curve=pshift_8)  # -> Start, End
end_21 = EndPoints(Curve=facade_curves_6)  # -> Start, End
ln_55 = Line(StartPoint=end_20.End, EndPoint=end_21.End)
ln_56 = Line(StartPoint=end_20.Start, EndPoint=end_21.Start)
join_17 = JoinCurves(Curves=[ln_55, ln_56, pshift_8], Preserve=False)
Z_26 = UnitZ(Factor=1)
extr_14 = Extrude(Base=join_17, Direction=Z_26)

facade_curves_7 = Data(gate_13.Target0)
offset_30 = OffsetCurve(Curve=facade_curves_7, Distance=expr("-x", facade_block2_balconywidth), Corners=1)
pshift_9 = ShiftPaths(Data=offset_30, Offset=-1)
end_22 = EndPoints(Curve=pshift_9)  # -> Start, End
end_23 = EndPoints(Curve=facade_curves_7)  # -> Start, End
ln_57 = Line(StartPoint=end_22.End, EndPoint=end_23.End)
ln_58 = Line(StartPoint=end_22.Start, EndPoint=end_23.Start)
join_18 = JoinCurves(Curves=[ln_57, ln_58, pshift_9, facade_curves_7], Preserve=False)
cls_13 = Closed(Curve=join_18)  # -> Closed, Periodic
join_19 = JoinCurves(Curves=[ln_57, ln_58, pshift_9], Preserve=False)
cull_26 = CullPattern(List=join_18, CullPattern=cls_13.Closed)
Z_27 = UnitZ(Factor=1)
extr_15 = Extrude(Base=join_19, Direction=Z_27)
srf_10 = Surface(cull_26)

mcol_47 = MeshColours(Mesh=[extr_15, extr_14, extr_13, srf_10], Colours=ColourSwatch(SwatchColor=RGB(79, 76, 76)))

mjoin_5 = MeshJoin(Meshes=[mcol_43, mcol_44, mcol_45, mcol_46, mcol_47])

floor_height_8 = Data(floor_height_5)
total_floor_height_2 = Data(multiplication_5)
glass_windows_2 = Data([ungroup_5, ungroup_12])
floor_height_9 = Data(Z_15)
merge_35 = Merge(Data1=ungroup_3, Data2=ungroup_4, Data3=ungroup_10, Data4=ungroup_11)
foorrplate_2 = Data(srf_7)
Z_28 = UnitZ(Factor=floor_height_8)
facade_curves_8 = Data(facade_2)
Z_29 = UnitZ(Factor=total_floor_height_2)
Z_30 = UnitZ(Factor=Slider(0.15, range=0..1))
debrep_5 = DeconstructBrep(Brep=glass_windows_2)  # -> Faces, Edges, Vertices
extr_16 = Extrude(Base=foorrplate_2, Direction=Z_30)
number_slider_9 = Slider(0.05, range=0..0.1)
facade_block1_balconywidth = GetNumber(Slider(1.2, range=0..2), AtLeast=1, AtMost=1, Maximum=1.797693135e+308, Minimum=-1.797693135e+308, TreeAccess=False)
cull_i_5 = CullIndex(List=floor_height_9, Indices="-1", Wrap=True)
item_44 = ListItem(List=debrep_5.Edges, Index=Slider(2, range=0..10), Wrap=True)
extr_17 = Extrude(Base=item_44, Direction=Z_28)  # -> flatten(Extrusion)
facade_block1_balconytype = GetNumber(Slider(2, range=0..3), AtLeast=1, AtMost=1, Maximum=1.797693135e+308, Minimum=-1.797693135e+308, TreeAccess=False)
extr_18 = Extrude(Base=merge_35, Direction=Z_29)
move_11 = Move(Geometry=extr_16, Motion=floor_height_9)  # -> Geometry, Transform
divide_2 = DivideCurve(Curve=item_44, Count=Slider(4, range=0..10), Kinks=False)  # -> Points, Tangents, Parameters
move_12 = Move(Geometry=facade_curves_8, Motion=graft(cull_i_5))  # -> Geometry, Transform
pl_5 = ConstructPlane(Origin=divide_2.Points, XAxis=item_44, YAxis=Vector(0, 1, 0))
gate_14 = StreamGate(Stream=move_12.Geometry, Gate=facade_block1_balconytype)  # -> Target0, Target1, Target2, Target3
move_13 = Move(Geometry=extr_17, Motion=graft(cull_i_5))  # -> Geometry, Transform
rectangle_3 = Rectangle(Plane=pl_5, XSize=number_slider_9, YSize=number_slider_9, Radius=0)  # -> Rectangle, Length
extr_19 = Extrude(Base=rectangle_3.Rectangle, Direction=Z_28)  # -> flatten(Extrusion)
move_14 = Move(Geometry=extr_19, Motion=graft(cull_i_5))  # -> Geometry, Transform
swatch_3 = ColourSwatch(SwatchColor=RGB(163, 163, 163))
facade_curves_9 = Data(gate_14.Target2)
mcol_48 = MeshColours(Mesh=extr_18, Colours=swatch_3)
mcol_49 = MeshColours(Mesh=move_11.Geometry, Colours=swatch_3)
mcol_50 = MeshColours(Mesh=[move_13.Geometry, extr_17], Colours=ColourSwatch(SwatchColor=RGBA(138, 201, 207, 46)))
mcol_51 = MeshColours(Mesh=[move_14.Geometry, extr_19], Colours=ColourSwatch(SwatchColor=RGBA(0, 0, 0, 63)))
offset_31 = OffsetCurve(Curve=facade_curves_9, Distance=expr("-x", facade_block1_balconywidth), Corners=1)
end_24 = EndPoints(Curve=facade_curves_9)  # -> Start, End
midpt_27 = CurveMiddle(Curve=offset_31)
pshift_10 = ShiftPaths(Data=midpt_27, Offset=-1)
ln_59 = Line(StartPoint=pshift_10, EndPoint=end_24.End)
ln_60 = Line(StartPoint=pshift_10, EndPoint=end_24.Start)
join_20 = JoinCurves(Curves=[ln_59, ln_60], Preserve=False)
Z_31 = UnitZ(Factor=1)
extr_20 = Extrude(Base=join_20, Direction=Z_31)

facade_curves_10 = Data(gate_14.Target1)
offset_32 = OffsetCurve(Curve=facade_curves_10, Distance=expr("-x", facade_block1_balconywidth), Corners=1)
midpt_28 = CurveMiddle(Curve=offset_32)
rotate_2 = Rotate(Geometry=offset_32, Angle=degrees(Slider(16, range=-20..20)), Plane=midpt_28)  # -> Geometry, Transform
pshift_11 = ShiftPaths(Data=rotate_2.Geometry, Offset=-1)
end_25 = EndPoints(Curve=pshift_11)  # -> Start, End
end_26 = EndPoints(Curve=facade_curves_10)  # -> Start, End
ln_61 = Line(StartPoint=end_25.End, EndPoint=end_26.End)
ln_62 = Line(StartPoint=end_25.Start, EndPoint=end_26.Start)
join_21 = JoinCurves(Curves=[ln_61, ln_62, pshift_11], Preserve=False)
Z_32 = UnitZ(Factor=1)
extr_21 = Extrude(Base=join_21, Direction=Z_32)

facade_curves_11 = Data(gate_14.Target0)
offset_33 = OffsetCurve(Curve=facade_curves_11, Distance=expr("-x", facade_block1_balconywidth), Corners=1)
pshift_12 = ShiftPaths(Data=offset_33, Offset=-1)
end_27 = EndPoints(Curve=pshift_12)  # -> Start, End
end_28 = EndPoints(Curve=facade_curves_11)  # -> Start, End
ln_63 = Line(StartPoint=end_27.End, EndPoint=end_28.End)
ln_64 = Line(StartPoint=end_27.Start, EndPoint=end_28.Start)
join_22 = JoinCurves(Curves=[ln_63, ln_64, pshift_12, facade_curves_11], Preserve=False)
cls_14 = Closed(Curve=join_22)  # -> Closed, Periodic
join_23 = JoinCurves(Curves=[ln_63, ln_64, pshift_12], Preserve=False)
cull_27 = CullPattern(List=join_22, CullPattern=cls_14.Closed)
Z_33 = UnitZ(Factor=1)
extr_22 = Extrude(Base=join_23, Direction=Z_33)
srf_11 = Surface(cull_27)

mcol_52 = MeshColours(Mesh=[extr_22, extr_21, extr_20, srf_11], Colours=ColourSwatch(SwatchColor=RGB(79, 76, 76)))

mjoin_6 = MeshJoin(Meshes=[mcol_48, mcol_49, mcol_50, mcol_51, mcol_52])
filter_17 = StreamFilter(Gate=floorplan.Equality, Stream1=[mjoin_6, mjoin_5])
mjoin_7 = MeshJoin(Meshes=flatten([merge, merge_17, filter_16, filter_5, filter_17]))

# ---- group: RH_OUT:meshout
mesh_12 = Mesh(mjoin_7)
